# Grasshopper definition 06 (1).gh (Grasshopper 1.0.7)
# plug-ins: Kangaroo Components

number_slider = Slider(489, range=0..1000)
number_slider_2 = Slider(0.431, range=0.4..0.5)
number_slider_3 = Slider(0.05, range=0.022..0.099)
number_slider_4 = Slider(-0.348, range=-10..10)
panel = Panel("""1
2
3
4
5
6
7
8
9""")
number_slider_5 = Slider(419, range=0..1000)
number_slider_6 = Slider(325, range=0..1000)
jitter = Jitter(List=panel, Jitter=1, Seed=number_slider)  # -> Values, Indices
list_item = ListItem(List=jitter.Values, Index=Slider(0, range=0..100), Wrap=True)
number_of_trunk_per_row = Slider(9, range=0..10)
number_slider_7 = Slider(0.017, range=0..0.1)
number_slider_8 = Slider(0.05, range=0.022..0.099)
number_slider_9 = Slider(0.825, range=-10..10)
panel_2 = Panel("""1
2
3
4
5
6
7
8
9""")
number_slider_10 = Slider(0.051, range=0.022..0.099)
number_slider_11 = Slider(1.656, range=-10..10)
# Put the triangle to the surface
#  (to calculate collision)
# Put the TRUNK to the surface
panel_3 = Panel(jitter.Values)
panel_4 = Panel("""1
2
3
4
5
6
7
8
9""")
number_slider_12 = Slider(1.1, range=1.05..1.1)
# Put the reference triangle to the surface
number_slider_13 = Slider(0.05, range=0..0.1)
jitter_2 = Jitter(List=panel_2, Jitter=1, Seed=number_slider_5)  # -> Values, Indices
list_item_2 = ListItem(List=jitter_2.Values, Index=Slider(0, range=0..100), Wrap=True)
jitter_3 = Jitter(List=panel_4, Jitter=1, Seed=number_slider_6)  # -> Values, Indices
list_item_3 = ListItem(List=jitter_3.Values, Index=Slider(27, range=0..100), Wrap=True)
division = Division(A=list_item, B=number_of_trunk_per_row)
# Variables for target location
# and slight rotation allowed
number_slider_14 = Slider(0, range=0..100)
number_of_trunk_per_row_2 = Slider(9, range=0..10)
number_of_trunk_per_row_3 = Slider(9, range=0..10)
# Put the reference triangle to the surface
# Put the triangle to the surface
#  (to calculate collision)
# Put the TRUNK to the surface
panel_5 = Panel(jitter_2.Values)
addition = Addition(A=number_slider_3, B=division)
addition_2 = Addition(A=addition, B=number_slider_13)
# Put the reference triangle to the surface
# Put the triangle to the surface
#  (to calculate collision)
# Put the TRUNK to the surface
panel_6 = Panel(jitter_3.Values)
radians = Radians(Degrees=number_slider_4)
construct_point = ConstructPoint(XCoordinate=number_slider_2, YCoordinate=addition_2, ZCoordinate=number_slider_14)
division_2 = Division(A=list_item_2, B=number_of_trunk_per_row_2)
# Variables for target location
# and slight rotation allowed
number_slider_15 = Slider(0, range=0..100)
division_3 = Division(A=list_item_3, B=number_of_trunk_per_row_3)
# Variables for target location
# and slight rotation allowed
number_slider_16 = Slider(0, range=0..100)
addition_3 = Addition(A=number_slider_8, B=division_2)
geometry = Geometry(<curve referenced from the Rhino model>)
geometry_2 = Geometry(<brep referenced from the Rhino model>)
geometry_3 = Geometry(<mesh referenced from the Rhino model>)
addition_4 = Addition(A=number_slider_10, B=division_3)
radians_2 = Radians(Degrees=number_slider_9)
construct_point_2 = ConstructPoint(XCoordinate=number_slider_7, YCoordinate=addition_3, ZCoordinate=number_slider_15)
radians_3 = Radians(Degrees=number_slider_11)
construct_point_3 = ConstructPoint(XCoordinate=number_slider_12, YCoordinate=addition_4, ZCoordinate=number_slider_16)
geometry_4 = Geometry(<curve referenced from the Rhino model>)
point = Point(<point referenced from the Rhino model>)
geometry_5 = Geometry(<curve referenced from the Rhino model>)
geometry_6 = Geometry(<brep referenced from the Rhino model>)
geometry_7 = Geometry(<mesh referenced from the Rhino model>)
geometry_8 = Geometry(<curve referenced from the Rhino model>)
geometry_9 = Geometry(<brep referenced from the Rhino model>)
geometry_10 = Geometry(<mesh referenced from the Rhino model>)
geometry_11 = Geometry(<curve referenced from the Rhino model>)
point_2 = Point(<point referenced from the Rhino model>)
geometry_12 = Geometry(<curve referenced from the Rhino model>)
point_3 = Point(<point referenced from the Rhino model>)

number_slider_17 = Slider(120, range=100..120)
number_slider_18 = Slider(60, range=60..70)
# Variables for the cone size
number_slider_19 = Slider(100, range=80..100)

construct_point_4 = ConstructPoint(XCoordinate=0, YCoordinate=0, ZCoordinate=number_slider_17)
point_4 = Point(Point(0, 0, 0))
circle_cnr = CircleCNR(Center=point_4, Normal=Vector(0, 0, 1), Radius=number_slider_19)
circle_cnr_2 = CircleCNR(Center=construct_point_4, Normal=Vector(0, 0, 1), Radius=number_slider_18)
# Fixed original direction
curve = Curve(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)
vector = Vector(curve)
number_slider_20 = Slider(0.446, range=0.4..0.5)
number_slider_21 = Slider(0.054, range=0.022..0.099)
number_slider_22 = Slider(-4.195, range=-10..10)
loft = Loft(
    Curves=[circle_cnr, circle_cnr_2],
    Options={Adjust=False, Closed=False, LoftEnds=0, LoftSimp=0, LoftType=0, Rebuild=10, Refit=0.01})
unit_vector = UnitVector(Vector=vector)
geometry_13 = Geometry(loft)
# Random Point on a Surface
surface = Surface(reparameterize(geometry_13))
evaluate_surface = EvaluateSurface(Surface=surface, Point=construct_point)  # -> Point, Normal, UDirection, VDirection, Frame
# Random Point on a Surface
surface_2 = Surface(reparameterize(geometry_13))
# T7
# Random Point on a Surface
surface_3 = Surface(reparameterize(geometry_13))
unit_vector_2 = UnitVector(Vector=evaluate_surface.Normal)
point_5 = Point(evaluate_surface.Point)
evaluate_surface_2 = EvaluateSurface(Surface=surface_2, Point=construct_point_2)  # -> Point, Normal, UDirection, VDirection, Frame
evaluate_surface_3 = EvaluateSurface(Surface=surface_3, Point=construct_point_3)  # -> Point, Normal, UDirection, VDirection, Frame
# Put the reference line to the surface
# (and correctly rotated/aligned)
orient_direction = OrientDirection(Geometry=geometry_4, PointA=point, DirectionA=unit_vector, PointB=point_5, DirectionB=unit_vector_2)  # -> Geometry, Transform
transform = Transform(Geometry=geometry_2, Transform=orient_direction.Transform)
transform_2 = Transform(Geometry=geometry, Transform=orient_direction.Transform)
point_6 = Point(evaluate_surface_2.Point)
unit_vector_3 = UnitVector(Vector=evaluate_surface_2.Normal)
point_7 = Point(evaluate_surface_3.Point)
unit_vector_4 = UnitVector(Vector=evaluate_surface_3.Normal)
orient_direction_2 = OrientDirection(
    Geometry=orient_direction.Geometry,
    PointA=point_5,
    DirectionA=orient_direction.Geometry,
    PointB=point_5,
    DirectionB=evaluate_surface.UDirection)  # -> Geometry, Transform
rotate = Rotate(Geometry=orient_direction_2.Geometry, Angle=radians, Plane=evaluate_surface.Frame)  # -> Geometry, Transform
transform_3 = Transform(Geometry=transform, Transform=orient_direction_2.Transform)
transform_4 = Transform(Geometry=transform_2, Transform=orient_direction_2.Transform)
transform_5 = Transform(Geometry=transform_3, Transform=rotate.Transform)
transform_6 = Transform(Geometry=transform_4, Transform=rotate.Transform)
triangle_mapping = TriangleMapping(Geometry=geometry_3, Source=geometry, Target=transform_6)  # -> Geometry, Transform
explode = Explode(Curve=transform_6, Recursive=True)  # -> Segments, Vertices
list_item_4 = ListItem(List=explode.Vertices, Index=Slider(3, range=0..10), Wrap=True)
list_item_5 = ListItem(List=explode.Vertices, Index=Slider(1, range=0..10), Wrap=True)
list_item_6 = ListItem(List=explode.Vertices, Index=Slider(2, range=0..10), Wrap=True)
# Put the reference line to the surface
# (and correctly rotated/aligned)
orient_direction_3 = OrientDirection(Geometry=geometry_11, PointA=point_2, DirectionA=unit_vector, PointB=point_6, DirectionB=unit_vector_3)  # -> Geometry, Transform
transform_7 = Transform(Geometry=geometry_6, Transform=orient_direction_3.Transform)
transform_8 = Transform(Geometry=geometry_5, Transform=orient_direction_3.Transform)
# Put the reference line to the surface
# (and correctly rotated/aligned)
orient_direction_4 = OrientDirection(Geometry=geometry_12, PointA=point_3, DirectionA=unit_vector, PointB=point_7, DirectionB=unit_vector_4)  # -> Geometry, Transform
transform_9 = Transform(Geometry=geometry_9, Transform=orient_direction_4.Transform)
transform_10 = Transform(Geometry=geometry_8, Transform=orient_direction_4.Transform)
removeduplicatepts = RemoveDuplicatePts(Points=explode.Vertices, Tolerance=0.01)
orient_direction_5 = OrientDirection(
    Geometry=orient_direction_3.Geometry,
    PointA=point_6,
    DirectionA=orient_direction_3.Geometry,
    PointB=point_6,
    DirectionB=evaluate_surface_2.UDirection)  # -> Geometry, Transform
rotate_2 = Rotate(Geometry=orient_direction_5.Geometry, Angle=radians_2, Plane=evaluate_surface_2.Frame)  # -> Geometry, Transform
transform_11 = Transform(Geometry=transform_7, Transform=orient_direction_5.Transform)
transform_12 = Transform(Geometry=transform_8, Transform=orient_direction_5.Transform)
transform_13 = Transform(Geometry=transform_11, Transform=rotate_2.Transform)
transform_14 = Transform(Geometry=transform_12, Transform=rotate_2.Transform)
triangle_mapping_2 = TriangleMapping(Geometry=geometry_7, Source=geometry_5, Target=transform_14)  # -> Geometry, Transform
explode_2 = Explode(Curve=transform_14, Recursive=True)  # -> Segments, Vertices
list_item_7 = ListItem(List=explode_2.Vertices, Index=Slider(3, range=0..10), Wrap=True)
list_item_8 = ListItem(List=explode_2.Vertices, Index=Slider(1, range=0..10), Wrap=True)
list_item_9 = ListItem(List=explode_2.Vertices, Index=Slider(2, range=0..10), Wrap=True)
point_8 = Point(removeduplicatepts)
orient_direction_6 = OrientDirection(
    Geometry=orient_direction_4.Geometry,
    PointA=point_7,
    DirectionA=orient_direction_4.Geometry,
    PointB=point_7,
    DirectionB=evaluate_surface_3.UDirection)  # -> Geometry, Transform
rotate_3 = Rotate(Geometry=orient_direction_6.Geometry, Angle=radians_3, Plane=evaluate_surface_3.Frame)  # -> Geometry, Transform
transform_15 = Transform(Geometry=transform_9, Transform=orient_direction_6.Transform)
transform_16 = Transform(Geometry=transform_10, Transform=orient_direction_6.Transform)
transform_17 = Transform(Geometry=transform_15, Transform=rotate_3.Transform)
transform_18 = Transform(Geometry=transform_16, Transform=rotate_3.Transform)
triangle_mapping_3 = TriangleMapping(Geometry=geometry_10, Source=geometry_8, Target=transform_18)  # -> Geometry, Transform
explode_3 = Explode(Curve=transform_18, Recursive=True)  # -> Segments, Vertices
list_item_10 = ListItem(List=explode_3.Vertices, Index=Slider(3, range=0..10), Wrap=True)
list_item_11 = ListItem(List=explode_3.Vertices, Index=Slider(1, range=0..10), Wrap=True)
list_item_12 = ListItem(List=explode_3.Vertices, Index=Slider(2, range=0..10), Wrap=True)
removeduplicatepts_2 = RemoveDuplicatePts(Points=explode_2.Vertices, Tolerance=0.01)
removeduplicatepts_3 = RemoveDuplicatePts(Points=explode_3.Vertices, Tolerance=0.01)
point_9 = Point(removeduplicatepts_2)
point_10 = Point(removeduplicatepts_3)
list_item_13 = ListItem(List=jitter.Values, Index=Slider(1, range=0..100), Wrap=True)
number_slider_23 = Slider(0.041, range=0..0.1)
number_slider_24 = Slider(0.054, range=0.022..0.099)
number_of_trunk_per_row_4 = Slider(9, range=0..10)
number_slider_25 = Slider(0.88, range=-10..10)
number_slider_26 = Slider(0.83, range=0.8..0.9)
number_slider_27 = Slider(0.054, range=0.022..0.099)
number_slider_28 = Slider(-2.92, range=-10..10)
list_item_14 = ListItem(List=jitter_2.Values, Index=Slider(1, range=0..100), Wrap=True)
list_item_15 = ListItem(List=jitter_3.Values, Index=Slider(1, range=0..100), Wrap=True)
# Put the reference triangle to the surface
# Put the triangle to the surface
#  (to calculate collision)
number_slider_29 = Slider(0.05, range=0..0.1)
division_4 = Division(A=list_item_13, B=number_of_trunk_per_row_4)
# Variables for target location
# and slight rotation allowed
number_slider_30 = Slider(0, range=0..100)
number_of_trunk_per_row_5 = Slider(9, range=0..10)
number_of_trunk_per_row_6 = Slider(9, range=0..10)
addition_5 = Addition(A=number_slider_21, B=division_4)
addition_6 = Addition(A=addition_5, B=number_slider_29)
construct_point_5 = ConstructPoint(XCoordinate=number_slider_20, YCoordinate=addition_6, ZCoordinate=number_slider_30)
radians_4 = Radians(Degrees=number_slider_22)
# Random Point on a Surface
surface_4 = Surface(reparameterize(geometry_13))
# Put the reference triangle to the surface
# Put the triangle to the surface
#  (to calculate collision)
division_5 = Division(A=list_item_14, B=number_of_trunk_per_row_5)
# Variables for target location
# and slight rotation allowed
number_slider_31 = Slider(0, range=0..100)
# Put the reference triangle to the surface
# Put the triangle to the surface
#  (to calculate collision)
division_6 = Division(A=list_item_15, B=number_of_trunk_per_row_6)
# Variables for target location
# and slight rotation allowed
number_slider_32 = Slider(0, range=0..100)
addition_7 = Addition(A=number_slider_24, B=division_5)
geometry_14 = Geometry(<brep referenced from the Rhino model>)
geometry_15 = Geometry(<curve referenced from the Rhino model>)
# Put the TRUNK to the surface
geometry_16 = Geometry(<mesh referenced from the Rhino model>)
evaluate_surface_4 = EvaluateSurface(Surface=surface_4, Point=construct_point_5)  # -> Point, Normal, UDirection, VDirection, Frame
addition_8 = Addition(A=number_slider_27, B=division_6)
construct_point_6 = ConstructPoint(XCoordinate=number_slider_23, YCoordinate=addition_7, ZCoordinate=number_slider_31)
radians_5 = Radians(Degrees=number_slider_25)
# Random Point on a Surface
surface_5 = Surface(reparameterize(geometry_13))
construct_point_7 = ConstructPoint(XCoordinate=number_slider_26, YCoordinate=addition_8, ZCoordinate=number_slider_32)
radians_6 = Radians(Degrees=number_slider_28)
# Random Point on a Surface
surface_6 = Surface(reparameterize(geometry_13))
unit_vector_5 = UnitVector(Vector=evaluate_surface_4.Normal)
geometry_17 = Geometry(<curve referenced from the Rhino model>)
point_11 = Point(<point referenced from the Rhino model>)
point_12 = Point(evaluate_surface_4.Point)
geometry_18 = Geometry(<curve referenced from the Rhino model>)
geometry_19 = Geometry(<brep referenced from the Rhino model>)
# Put the TRUNK to the surface
geometry_20 = Geometry(<mesh referenced from the Rhino model>)
evaluate_surface_5 = EvaluateSurface(Surface=surface_5, Point=construct_point_6)  # -> Point, Normal, UDirection, VDirection, Frame
geometry_21 = Geometry(<curve referenced from the Rhino model>)
geometry_22 = Geometry(<brep referenced from the Rhino model>)
# Put the TRUNK to the surface
geometry_23 = Geometry(<mesh referenced from the Rhino model>)
evaluate_surface_6 = EvaluateSurface(Surface=surface_6, Point=construct_point_7)  # -> Point, Normal, UDirection, VDirection, Frame
# Put the reference line to the surface
# (and correctly rotated/aligned)
orient_direction_7 = OrientDirection(Geometry=geometry_17, PointA=point_11, DirectionA=unit_vector, PointB=point_12, DirectionB=unit_vector_5)  # -> Geometry, Transform
transform_19 = Transform(Geometry=geometry_14, Transform=orient_direction_7.Transform)
transform_20 = Transform(Geometry=geometry_15, Transform=orient_direction_7.Transform)
unit_vector_6 = UnitVector(Vector=evaluate_surface_5.Normal)
geometry_24 = Geometry(<curve referenced from the Rhino model>)
point_13 = Point(<point referenced from the Rhino model>)
point_14 = Point(evaluate_surface_5.Point)
unit_vector_7 = UnitVector(Vector=evaluate_surface_6.Normal)
geometry_25 = Geometry(<curve referenced from the Rhino model>)
point_15 = Point(<point referenced from the Rhino model>)
point_16 = Point(evaluate_surface_6.Point)
orient_direction_8 = OrientDirection(
    Geometry=orient_direction_7.Geometry,
    PointA=point_12,
    DirectionA=orient_direction_7.Geometry,
    PointB=point_12,
    DirectionB=evaluate_surface_4.UDirection)  # -> Geometry, Transform
rotate_4 = Rotate(Geometry=orient_direction_8.Geometry, Angle=radians_4, Plane=evaluate_surface_4.Frame)  # -> Geometry, Transform
transform_21 = Transform(Geometry=transform_19, Transform=orient_direction_8.Transform)
transform_22 = Transform(Geometry=transform_20, Transform=orient_direction_8.Transform)
transform_23 = Transform(Geometry=transform_21, Transform=rotate_4.Transform)
transform_24 = Transform(Geometry=transform_22, Transform=rotate_4.Transform)
triangle_mapping_4 = TriangleMapping(Geometry=geometry_16, Source=geometry_15, Target=transform_24)  # -> Geometry, Transform
custom_preview = CustomPreview(
    Geometry=triangle_mapping_4.Geometry,
    Material={diffuse=RGB(221, 160, 221), emission=RGB(66, 48, 66), shine=0.5, specular=RGB(255, 255, 255), transparency=0})
explode_4 = Explode(Curve=transform_24, Recursive=True)  # -> Segments, Vertices
list_item_16 = ListItem(List=explode_4.Vertices, Index=Slider(3, range=0..10), Wrap=True)
list_item_17 = ListItem(List=explode_4.Vertices, Index=Slider(1, range=0..10), Wrap=True)
list_item_18 = ListItem(List=explode_4.Vertices, Index=Slider(2, range=0..10), Wrap=True)
# Put the reference line to the surface
# (and correctly rotated/aligned)
orient_direction_9 = OrientDirection(Geometry=geometry_24, PointA=point_13, DirectionA=unit_vector, PointB=point_14, DirectionB=unit_vector_6)  # -> Geometry, Transform
transform_25 = Transform(Geometry=geometry_19, Transform=orient_direction_9.Transform)
transform_26 = Transform(Geometry=geometry_18, Transform=orient_direction_9.Transform)
# Put the reference line to the surface
# (and correctly rotated/aligned)
orient_direction_10 = OrientDirection(Geometry=geometry_25, PointA=point_15, DirectionA=unit_vector, PointB=point_16, DirectionB=unit_vector_7)  # -> Geometry, Transform
transform_27 = Transform(Geometry=geometry_22, Transform=orient_direction_10.Transform)
transform_28 = Transform(Geometry=geometry_21, Transform=orient_direction_10.Transform)
# Position
number_slider_33 = Slider(2, range=0..10)
removeduplicatepts_4 = RemoveDuplicatePts(Points=explode_4.Vertices, Tolerance=0.01)
orient_direction_11 = OrientDirection(
    Geometry=orient_direction_9.Geometry,
    PointA=point_14,
    DirectionA=orient_direction_9.Geometry,
    PointB=point_14,
    DirectionB=evaluate_surface_5.UDirection)  # -> Geometry, Transform
rotate_5 = Rotate(Geometry=orient_direction_11.Geometry, Angle=radians_5, Plane=evaluate_surface_5.Frame)  # -> Geometry, Transform
transform_29 = Transform(Geometry=transform_25, Transform=orient_direction_11.Transform)
transform_30 = Transform(Geometry=transform_26, Transform=orient_direction_11.Transform)
transform_31 = Transform(Geometry=transform_29, Transform=rotate_5.Transform)
transform_32 = Transform(Geometry=transform_30, Transform=rotate_5.Transform)
triangle_mapping_5 = TriangleMapping(Geometry=geometry_20, Source=geometry_18, Target=transform_32)  # -> Geometry, Transform
custom_preview_2 = CustomPreview(
    Geometry=triangle_mapping_5.Geometry,
    Material={diffuse=RGB(221, 160, 221), emission=RGB(66, 48, 66), shine=0.5, specular=RGB(255, 255, 255), transparency=0})
explode_5 = Explode(Curve=transform_32, Recursive=True)  # -> Segments, Vertices
list_item_19 = ListItem(List=explode_5.Vertices, Index=Slider(3, range=0..10), Wrap=True)
list_item_20 = ListItem(List=explode_5.Vertices, Index=Slider(1, range=0..10), Wrap=True)
list_item_21 = ListItem(List=explode_5.Vertices, Index=Slider(2, range=0..10), Wrap=True)
point_17 = Point(removeduplicatepts_4)
orient_direction_12 = OrientDirection(
    Geometry=orient_direction_10.Geometry,
    PointA=point_16,
    DirectionA=orient_direction_10.Geometry,
    PointB=point_16,
    DirectionB=evaluate_surface_6.UDirection)  # -> Geometry, Transform
rotate_6 = Rotate(Geometry=orient_direction_12.Geometry, Angle=radians_6, Plane=evaluate_surface_6.Frame)  # -> Geometry, Transform
transform_33 = Transform(Geometry=transform_27, Transform=orient_direction_12.Transform)
transform_34 = Transform(Geometry=transform_28, Transform=orient_direction_12.Transform)
transform_35 = Transform(Geometry=transform_33, Transform=rotate_6.Transform)
transform_36 = Transform(Geometry=transform_34, Transform=rotate_6.Transform)
triangle_mapping_6 = TriangleMapping(Geometry=geometry_23, Source=geometry_21, Target=transform_36)  # -> Geometry, Transform
custom_preview_3 = CustomPreview(
    Geometry=triangle_mapping_6.Geometry,
    Material={diffuse=RGB(221, 160, 221), emission=RGB(66, 48, 66), shine=0.5, specular=RGB(255, 255, 255), transparency=0})
explode_6 = Explode(Curve=transform_36, Recursive=True)  # -> Segments, Vertices
list_item_22 = ListItem(List=explode_6.Vertices, Index=Slider(3, range=0..10), Wrap=True)
list_item_23 = ListItem(List=explode_6.Vertices, Index=Slider(1, range=0..10), Wrap=True)
list_item_24 = ListItem(List=explode_6.Vertices, Index=number_slider_33, Wrap=True)
removeduplicatepts_5 = RemoveDuplicatePts(Points=explode_5.Vertices, Tolerance=0.01)
removeduplicatepts_6 = RemoveDuplicatePts(Points=explode_6.Vertices, Tolerance=0.01)
point_18 = Point(removeduplicatepts_5)
point_19 = Point(removeduplicatepts_6)
number_slider_34 = Slider(0.455, range=0.4..0.5)
number_slider_35 = Slider(0.055, range=0.022..0.099)
number_slider_36 = Slider(0.939, range=-10..10)
list_item_25 = ListItem(List=jitter.Values, Index=Slider(2, range=0..100), Wrap=True)
number_slider_37 = Slider(0.5, range=0.5..0.501)
number_slider_38 = Slider(0.053, range=0.022..0.099)
number_of_trunk_per_row_7 = Slider(9, range=0..10)
number_slider_39 = Slider(-0.788, range=-10..10)
# t8
number_slider_40 = Slider(0.8, range=0.8..0.9)
number_slider_41 = Slider(0.099, range=0.022..0.099)
number_slider_42 = Slider(-10, range=-10..10)
# Put the reference triangle to the surface
# Put the triangle to the surface
#  (to calculate collision)
number_slider_43 = Slider(0.05, range=0..0.1)
list_item_26 = ListItem(List=jitter_2.Values, Index=Slider(2, range=0..100), Wrap=True)
# Variables for target location
# and slight rotation allowed
division_7 = Division(A=list_item_25, B=number_of_trunk_per_row_7)
list_item_27 = ListItem(List=jitter_3.Values, Index=Slider(91, range=0..100), Wrap=True)
number_of_trunk_per_row_8 = Slider(9, range=0..10)
number_of_trunk_per_row_9 = Slider(9, range=0..10)
addition_9 = Addition(A=number_slider_35, B=division_7)
addition_10 = Addition(A=addition_9, B=number_slider_43)
construct_point_8 = ConstructPoint(XCoordinate=number_slider_34, YCoordinate=addition_10, ZCoordinate=Slider(0, range=0..100))
radians_7 = Radians(Degrees=number_slider_36)
# Random Point on a Surface
surface_7 = Surface(reparameterize(geometry_13))
# Put the reference triangle to the surface
# Put the triangle to the surface
#  (to calculate collision)
division_8 = Division(A=list_item_26, B=number_of_trunk_per_row_8)
# Variables for target location
# and slight rotation allowed
number_slider_44 = Slider(0, range=0..100)
# Put the reference triangle to the surface
# Put the triangle to the surface
#  (to calculate collision)
division_9 = Division(A=list_item_27, B=number_of_trunk_per_row_9)
# Variables for target location
# and slight rotation allowed
number_slider_45 = Slider(0, range=0..100)
addition_11 = Addition(A=number_slider_38, B=division_8)
geometry_26 = Geometry(<curve referenced from the Rhino model>)
geometry_27 = Geometry(<brep referenced from the Rhino model>)
# Put the TRUNK to the surface
geometry_28 = Geometry(<mesh referenced from the Rhino model>)
evaluate_surface_7 = EvaluateSurface(Surface=surface_7, Point=construct_point_8)  # -> Point, Normal, UDirection, VDirection, Frame
addition_12 = Addition(A=number_slider_41, B=division_9)
construct_point_9 = ConstructPoint(XCoordinate=number_slider_37, YCoordinate=addition_11, ZCoordinate=number_slider_44)
radians_8 = Radians(Degrees=number_slider_39)
# Random Point on a Surface
surface_8 = Surface(reparameterize(geometry_13))
construct_point_10 = ConstructPoint(XCoordinate=number_slider_40, YCoordinate=addition_12, ZCoordinate=number_slider_45)
radians_9 = Radians(Degrees=number_slider_42)
# Random Point on a Surface
surface_9 = Surface(reparameterize(geometry_13))
unit_vector_8 = UnitVector(Vector=evaluate_surface_7.Normal)
geometry_29 = Geometry(<curve referenced from the Rhino model>)
point_20 = Point(<point referenced from the Rhino model>)
point_21 = Point(evaluate_surface_7.Point)
geometry_30 = Geometry(<curve referenced from the Rhino model>)
geometry_31 = Geometry(<brep referenced from the Rhino model>)
# Put the TRUNK to the surface
geometry_32 = Geometry(<mesh referenced from the Rhino model>)
evaluate_surface_8 = EvaluateSurface(Surface=surface_8, Point=construct_point_9)  # -> Point, Normal, UDirection, VDirection, Frame
geometry_33 = Geometry(<curve referenced from the Rhino model>)
geometry_34 = Geometry(<brep referenced from the Rhino model>)
# Put the TRUNK to the surface
geometry_35 = Geometry(<mesh referenced from the Rhino model>)
evaluate_surface_9 = EvaluateSurface(Surface=surface_9, Point=construct_point_10)  # -> Point, Normal, UDirection, VDirection, Frame
# Put the reference line to the surface
# (and correctly rotated/aligned)
orient_direction_13 = OrientDirection(Geometry=geometry_29, PointA=point_20, DirectionA=unit_vector, PointB=point_21, DirectionB=unit_vector_8)  # -> Geometry, Transform
transform_37 = Transform(Geometry=geometry_27, Transform=orient_direction_13.Transform)
transform_38 = Transform(Geometry=geometry_26, Transform=orient_direction_13.Transform)
unit_vector_9 = UnitVector(Vector=evaluate_surface_8.Normal)
# T4
# T4
geometry_36 = Geometry(<curve referenced from the Rhino model>)
point_22 = Point(<point referenced from the Rhino model>)
point_23 = Point(evaluate_surface_8.Point)
point_24 = Point(evaluate_surface_9.Point)
unit_vector_10 = UnitVector(Vector=evaluate_surface_9.Normal)
geometry_37 = Geometry(<curve referenced from the Rhino model>)
point_25 = Point(<point referenced from the Rhino model>)
orient_direction_14 = OrientDirection(
    Geometry=orient_direction_13.Geometry,
    PointA=point_21,
    DirectionA=orient_direction_13.Geometry,
    PointB=point_21,
    DirectionB=evaluate_surface_7.UDirection)  # -> Geometry, Transform
rotate_7 = Rotate(Geometry=orient_direction_14.Geometry, Angle=radians_7, Plane=evaluate_surface_7.Frame)  # -> Geometry, Transform
transform_39 = Transform(Geometry=transform_37, Transform=orient_direction_14.Transform)
transform_40 = Transform(Geometry=transform_38, Transform=orient_direction_14.Transform)
transform_41 = Transform(Geometry=transform_39, Transform=rotate_7.Transform)
transform_42 = Transform(Geometry=transform_40, Transform=rotate_7.Transform)
triangle_mapping_7 = TriangleMapping(Geometry=geometry_28, Source=geometry_26, Target=transform_42)  # -> Geometry, Transform
explode_7 = Explode(Curve=transform_42, Recursive=True)  # -> Segments, Vertices
list_item_28 = ListItem(List=explode_7.Vertices, Index=Slider(3, range=0..10), Wrap=True)
list_item_29 = ListItem(List=explode_7.Vertices, Index=Slider(1, range=0..10), Wrap=True)
list_item_30 = ListItem(List=explode_7.Vertices, Index=Slider(2, range=0..10), Wrap=True)
# Put the reference line to the surface
# (and correctly rotated/aligned)
orient_direction_15 = OrientDirection(Geometry=geometry_36, PointA=point_22, DirectionA=unit_vector, PointB=point_23, DirectionB=unit_vector_9)  # -> Geometry, Transform
transform_43 = Transform(Geometry=geometry_31, Transform=orient_direction_15.Transform)
transform_44 = Transform(Geometry=geometry_30, Transform=orient_direction_15.Transform)
# Put the reference line to the surface
# (and correctly rotated/aligned)
orient_direction_16 = OrientDirection(Geometry=geometry_37, PointA=point_25, DirectionA=unit_vector, PointB=point_24, DirectionB=unit_vector_10)  # -> Geometry, Transform
transform_45 = Transform(Geometry=geometry_34, Transform=orient_direction_16.Transform)
transform_46 = Transform(Geometry=geometry_33, Transform=orient_direction_16.Transform)
removeduplicatepts_7 = RemoveDuplicatePts(Points=explode_7.Vertices, Tolerance=0.01)
orient_direction_17 = OrientDirection(
    Geometry=orient_direction_15.Geometry,
    PointA=point_23,
    DirectionA=orient_direction_15.Geometry,
    PointB=point_23,
    DirectionB=evaluate_surface_8.UDirection)  # -> Geometry, Transform
rotate_8 = Rotate(Geometry=orient_direction_17.Geometry, Angle=radians_8, Plane=evaluate_surface_8.Frame)  # -> Geometry, Transform
transform_47 = Transform(Geometry=transform_43, Transform=orient_direction_17.Transform)
transform_48 = Transform(Geometry=transform_44, Transform=orient_direction_17.Transform)
transform_49 = Transform(Geometry=transform_47, Transform=rotate_8.Transform)
transform_50 = Transform(Geometry=transform_48, Transform=rotate_8.Transform)
triangle_mapping_8 = TriangleMapping(Geometry=geometry_32, Source=geometry_30, Target=transform_50)  # -> Geometry, Transform
explode_8 = Explode(Curve=transform_50, Recursive=True)  # -> Segments, Vertices
list_item_31 = ListItem(List=explode_8.Vertices, Index=Slider(3, range=0..10), Wrap=True)
list_item_32 = ListItem(List=explode_8.Vertices, Index=Slider(1, range=0..10), Wrap=True)
list_item_33 = ListItem(List=explode_8.Vertices, Index=Slider(2, range=0..10), Wrap=True)
point_26 = Point(removeduplicatepts_7)
orient_direction_18 = OrientDirection(
    Geometry=orient_direction_16.Geometry,
    PointA=point_24,
    DirectionA=orient_direction_16.Geometry,
    PointB=point_24,
    DirectionB=evaluate_surface_9.UDirection)  # -> Geometry, Transform
rotate_9 = Rotate(Geometry=orient_direction_18.Geometry, Angle=radians_9, Plane=evaluate_surface_9.Frame)  # -> Geometry, Transform
transform_51 = Transform(Geometry=transform_45, Transform=orient_direction_18.Transform)
transform_52 = Transform(Geometry=transform_46, Transform=orient_direction_18.Transform)
transform_53 = Transform(Geometry=transform_51, Transform=rotate_9.Transform)
transform_54 = Transform(Geometry=transform_52, Transform=rotate_9.Transform)
triangle_mapping_9 = TriangleMapping(Geometry=geometry_35, Source=geometry_33, Target=transform_54)  # -> Geometry, Transform
explode_9 = Explode(Curve=transform_54, Recursive=True)  # -> Segments, Vertices
list_item_34 = ListItem(List=explode_9.Vertices, Index=Slider(3, range=0..10), Wrap=True)
list_item_35 = ListItem(List=explode_9.Vertices, Index=Slider(1, range=0..10), Wrap=True)
list_item_36 = ListItem(List=explode_9.Vertices, Index=Slider(2, range=0..10), Wrap=True)
removeduplicatepts_8 = RemoveDuplicatePts(Points=explode_8.Vertices, Tolerance=0.01)
removeduplicatepts_9 = RemoveDuplicatePts(Points=explode_9.Vertices, Tolerance=0.01)
point_27 = Point(removeduplicatepts_8)
point_28 = Point(removeduplicatepts_9)
number_slider_46 = Slider(0.445, range=0.4..0.5)
number_slider_47 = Slider(0.065, range=0.022..0.099)
number_slider_48 = Slider(-0.395, range=-10..10)
list_item_37 = ListItem(List=jitter.Values, Index=Slider(3, range=0..100), Wrap=True)
number_slider_49 = Slider(0.5, range=0.499..0.5)
number_slider_50 = Slider(0.099, range=0.022..0.099)
number_of_trunk_per_row_10 = Slider(9, range=0..10)
number_slider_51 = Slider(10, range=-10..10)
number_slider_52 = Slider(0.936, range=-10..10)
number_slider_53 = Slider(0.827, range=0.8..0.9)
number_slider_54 = Slider(0.048, range=0.022..0.099)
list_item_38 = ListItem(List=jitter_2.Values, Index=Slider(3, range=0..100), Wrap=True)
# Put the reference triangle to the surface
# Put the triangle to the surface
#  (to calculate collision)
number_slider_55 = Slider(0.05, range=0..0.1)
list_item_39 = ListItem(List=jitter_3.Values, Index=Slider(3, range=0..100), Wrap=True)
# Variables for target location
# and slight rotation allowed
division_10 = Division(A=list_item_37, B=number_of_trunk_per_row_10)
number_of_trunk_per_row_11 = Slider(9, range=0..10)
number_of_trunk_per_row_12 = Slider(9, range=0..10)
addition_13 = Addition(A=number_slider_47, B=division_10)
addition_14 = Addition(A=addition_13, B=number_slider_55)
construct_point_11 = ConstructPoint(XCoordinate=number_slider_46, YCoordinate=addition_14, ZCoordinate=Slider(0, range=0..100))
radians_10 = Radians(Degrees=number_slider_48)
# Random Point on a Surface
surface_10 = Surface(reparameterize(geometry_13))
# Put the reference triangle to the surface
# Put the triangle to the surface
#  (to calculate collision)
division_11 = Division(A=list_item_38, B=number_of_trunk_per_row_11)
# Variables for target location
# and slight rotation allowed
number_slider_56 = Slider(0, range=0..100)
# Put the reference triangle to the surface
# Put the triangle to the surface
#  (to calculate collision)
division_12 = Division(A=list_item_39, B=number_of_trunk_per_row_12)
# Variables for target location
# and slight rotation allowed
number_slider_57 = Slider(0, range=0..100)
addition_15 = Addition(A=number_slider_50, B=division_11)
geometry_38 = Geometry(<curve referenced from the Rhino model>)
geometry_39 = Geometry(<brep referenced from the Rhino model>)
# Put the TRUNK to the surface
geometry_40 = Geometry(<mesh referenced from the Rhino model>)
evaluate_surface_10 = EvaluateSurface(Surface=surface_10, Point=construct_point_11)  # -> Point, Normal, UDirection, VDirection, Frame
addition_16 = Addition(A=number_slider_54, B=division_12)
construct_point_12 = ConstructPoint(XCoordinate=number_slider_49, YCoordinate=addition_15, ZCoordinate=number_slider_56)
radians_11 = Radians(Degrees=number_slider_51)
# Random Point on a Surface
surface_11 = Surface(reparameterize(geometry_13))
construct_point_13 = ConstructPoint(XCoordinate=number_slider_53, YCoordinate=addition_16, ZCoordinate=number_slider_57)
radians_12 = Radians(Degrees=number_slider_52)
# Random Point on a Surface
surface_12 = Surface(reparameterize(geometry_13))
unit_vector_11 = UnitVector(Vector=evaluate_surface_10.Normal)
geometry_41 = Geometry(<curve referenced from the Rhino model>)
point_29 = Point(<point referenced from the Rhino model>)
point_30 = Point(evaluate_surface_10.Point)
geometry_42 = Geometry(<brep referenced from the Rhino model>)
geometry_43 = Geometry(<curve referenced from the Rhino model>)
# Put the TRUNK to the surface
geometry_44 = Geometry(<mesh referenced from the Rhino model>)
evaluate_surface_11 = EvaluateSurface(Surface=surface_11, Point=construct_point_12)  # -> Point, Normal, UDirection, VDirection, Frame
geometry_45 = Geometry(<curve referenced from the Rhino model>)
geometry_46 = Geometry(<brep referenced from the Rhino model>)
# Put the TRUNK to the surface
geometry_47 = Geometry(<mesh referenced from the Rhino model>)
evaluate_surface_12 = EvaluateSurface(Surface=surface_12, Point=construct_point_13)  # -> Point, Normal, UDirection, VDirection, Frame
# Put the reference line to the surface
# (and correctly rotated/aligned)
orient_direction_19 = OrientDirection(Geometry=geometry_41, PointA=point_29, DirectionA=unit_vector, PointB=point_30, DirectionB=unit_vector_11)  # -> Geometry, Transform
transform_55 = Transform(Geometry=geometry_39, Transform=orient_direction_19.Transform)
transform_56 = Transform(Geometry=geometry_38, Transform=orient_direction_19.Transform)
unit_vector_12 = UnitVector(Vector=evaluate_surface_11.Normal)
# T5
geometry_48 = Geometry(<curve referenced from the Rhino model>)
point_31 = Point(<point referenced from the Rhino model>)
point_32 = Point(evaluate_surface_11.Point)
unit_vector_13 = UnitVector(Vector=evaluate_surface_12.Normal)
geometry_49 = Geometry(<curve referenced from the Rhino model>)
point_33 = Point(<point referenced from the Rhino model>)
point_34 = Point(evaluate_surface_12.Point)
orient_direction_20 = OrientDirection(
    Geometry=orient_direction_19.Geometry,
    PointA=point_30,
    DirectionA=orient_direction_19.Geometry,
    PointB=point_30,
    DirectionB=evaluate_surface_10.UDirection)  # -> Geometry, Transform
rotate_10 = Rotate(Geometry=orient_direction_20.Geometry, Angle=radians_10, Plane=evaluate_surface_10.Frame)  # -> Geometry, Transform
transform_57 = Transform(Geometry=transform_55, Transform=orient_direction_20.Transform)
transform_58 = Transform(Geometry=transform_56, Transform=orient_direction_20.Transform)
transform_59 = Transform(Geometry=transform_57, Transform=rotate_10.Transform)
transform_60 = Transform(Geometry=transform_58, Transform=rotate_10.Transform)
triangle_mapping_10 = TriangleMapping(Geometry=geometry_40, Source=geometry_38, Target=transform_60)  # -> Geometry, Transform
explode_10 = Explode(Curve=transform_60, Recursive=True)  # -> Segments, Vertices
list_item_40 = ListItem(List=explode_10.Vertices, Index=Slider(3, range=0..10), Wrap=True)
list_item_41 = ListItem(List=explode_10.Vertices, Index=Slider(1, range=0..10), Wrap=True)
list_item_42 = ListItem(List=explode_10.Vertices, Index=Slider(2, range=0..10), Wrap=True)
# Put the reference line to the surface
# (and correctly rotated/aligned)
orient_direction_21 = OrientDirection(Geometry=geometry_48, PointA=point_31, DirectionA=unit_vector, PointB=point_32, DirectionB=unit_vector_12)  # -> Geometry, Transform
transform_61 = Transform(Geometry=geometry_42, Transform=orient_direction_21.Transform)
transform_62 = Transform(Geometry=geometry_43, Transform=orient_direction_21.Transform)
# Put the reference line to the surface
# (and correctly rotated/aligned)
orient_direction_22 = OrientDirection(Geometry=geometry_49, PointA=point_33, DirectionA=unit_vector, PointB=point_34, DirectionB=unit_vector_13)  # -> Geometry, Transform
transform_63 = Transform(Geometry=geometry_46, Transform=orient_direction_22.Transform)
transform_64 = Transform(Geometry=geometry_45, Transform=orient_direction_22.Transform)
removeduplicatepts_10 = RemoveDuplicatePts(Points=explode_10.Vertices, Tolerance=0.01)
orient_direction_23 = OrientDirection(
    Geometry=orient_direction_21.Geometry,
    PointA=point_32,
    DirectionA=orient_direction_21.Geometry,
    PointB=point_32,
    DirectionB=evaluate_surface_11.UDirection)  # -> Geometry, Transform
rotate_11 = Rotate(Geometry=orient_direction_23.Geometry, Angle=radians_11, Plane=evaluate_surface_11.Frame)  # -> Geometry, Transform
transform_65 = Transform(Geometry=transform_61, Transform=orient_direction_23.Transform)
transform_66 = Transform(Geometry=transform_62, Transform=orient_direction_23.Transform)
transform_67 = Transform(Geometry=transform_65, Transform=rotate_11.Transform)
transform_68 = Transform(Geometry=transform_66, Transform=rotate_11.Transform)
triangle_mapping_11 = TriangleMapping(Geometry=geometry_44, Source=geometry_43, Target=transform_68)  # -> Geometry, Transform
explode_11 = Explode(Curve=transform_68, Recursive=True)  # -> Segments, Vertices
list_item_43 = ListItem(List=explode_11.Vertices, Index=Slider(3, range=0..10), Wrap=True)
list_item_44 = ListItem(List=explode_11.Vertices, Index=Slider(1, range=0..10), Wrap=True)
list_item_45 = ListItem(List=explode_11.Vertices, Index=Slider(2, range=0..10), Wrap=True)
point_35 = Point(removeduplicatepts_10)
orient_direction_24 = OrientDirection(
    Geometry=orient_direction_22.Geometry,
    PointA=point_34,
    DirectionA=orient_direction_22.Geometry,
    PointB=point_34,
    DirectionB=evaluate_surface_12.UDirection)  # -> Geometry, Transform
rotate_12 = Rotate(Geometry=orient_direction_24.Geometry, Angle=radians_12, Plane=evaluate_surface_12.Frame)  # -> Geometry, Transform
transform_69 = Transform(Geometry=transform_63, Transform=orient_direction_24.Transform)
transform_70 = Transform(Geometry=transform_64, Transform=orient_direction_24.Transform)
transform_71 = Transform(Geometry=transform_69, Transform=rotate_12.Transform)
transform_72 = Transform(Geometry=transform_70, Transform=rotate_12.Transform)
triangle_mapping_12 = TriangleMapping(Geometry=geometry_47, Source=geometry_45, Target=transform_72)  # -> Geometry, Transform
explode_12 = Explode(Curve=transform_72, Recursive=True)  # -> Segments, Vertices
list_item_46 = ListItem(List=explode_12.Vertices, Index=Slider(3, range=0..10), Wrap=True)
list_item_47 = ListItem(List=explode_12.Vertices, Index=Slider(1, range=0..10), Wrap=True)
list_item_48 = ListItem(List=explode_12.Vertices, Index=Slider(2, range=0..10), Wrap=True)
removeduplicatepts_11 = RemoveDuplicatePts(Points=explode_11.Vertices, Tolerance=0.01)
removeduplicatepts_12 = RemoveDuplicatePts(Points=explode_12.Vertices, Tolerance=0.01)
point_36 = Point(removeduplicatepts_11)
point_37 = Point(removeduplicatepts_12)
number_slider_58 = Slider(0.448, range=0.4..0.5)
number_slider_59 = Slider(0.052, range=0.022..0.099)
number_slider_60 = Slider(1.757, range=-10..10)
list_item_49 = ListItem(List=jitter.Values, Index=Slider(4, range=0..100), Wrap=True)
number_slider_61 = Slider(0.043, range=0..0.1)
number_slider_62 = Slider(0.055, range=0.022..0.099)
number_of_trunk_per_row_13 = Slider(9, range=0..10)
number_slider_63 = Slider(-0.33, range=-10..10)
number_slider_64 = Slider(0.83, range=0.8..0.9)
number_slider_65 = Slider(0.043, range=0.022..0.099)
number_slider_66 = Slider(0.111, range=-10..10)
list_item_50 = ListItem(List=jitter_2.Values, Index=Slider(4, range=0..100), Wrap=True)
list_item_51 = ListItem(List=jitter_3.Values, Index=Slider(4, range=0..100), Wrap=True)
# Put the reference triangle to the surface
# Put the triangle to the surface
#  (to calculate collision)
number_slider_67 = Slider(0.05, range=0..0.1)
division_13 = Division(A=list_item_49, B=number_of_trunk_per_row_13)
# Variables for target location
# and slight rotation allowed
number_slider_68 = Slider(0, range=0..100)
number_of_trunk_per_row_14 = Slider(9, range=0..10)
number_of_trunk_per_row_15 = Slider(9, range=0..10)
addition_17 = Addition(A=number_slider_59, B=division_13)
addition_18 = Addition(A=addition_17, B=number_slider_67)
construct_point_14 = ConstructPoint(XCoordinate=number_slider_58, YCoordinate=addition_18, ZCoordinate=number_slider_68)
radians_13 = Radians(Degrees=number_slider_60)
# Random Point on a Surface
surface_13 = Surface(reparameterize(geometry_13))
# Put the reference triangle to the surface
# Put the triangle to the surface
#  (to calculate collision)
division_14 = Division(A=list_item_50, B=number_of_trunk_per_row_14)
# Variables for target location
# and slight rotation allowed
number_slider_69 = Slider(0, range=0..100)
# Put the reference triangle to the surface
# Put the triangle to the surface
#  (to calculate collision)
division_15 = Division(A=list_item_51, B=number_of_trunk_per_row_15)
# Variables for target location
# and slight rotation allowed
number_slider_70 = Slider(0, range=0..100)
addition_19 = Addition(A=number_slider_62, B=division_14)
geometry_50 = Geometry(<curve referenced from the Rhino model>)
geometry_51 = Geometry(<brep referenced from the Rhino model>)
# Put the TRUNK to the surface
geometry_52 = Geometry(<mesh referenced from the Rhino model>)
evaluate_surface_13 = EvaluateSurface(Surface=surface_13, Point=construct_point_14)  # -> Point, Normal, UDirection, VDirection, Frame
addition_20 = Addition(A=number_slider_65, B=division_15)
construct_point_15 = ConstructPoint(XCoordinate=number_slider_61, YCoordinate=addition_19, ZCoordinate=number_slider_69)
radians_14 = Radians(Degrees=number_slider_63)
# Random Point on a Surface
surface_14 = Surface(reparameterize(geometry_13))
construct_point_16 = ConstructPoint(XCoordinate=number_slider_64, YCoordinate=addition_20, ZCoordinate=number_slider_70)
radians_15 = Radians(Degrees=number_slider_66)
# Random Point on a Surface
surface_15 = Surface(reparameterize(geometry_13))
unit_vector_14 = UnitVector(Vector=evaluate_surface_13.Normal)
geometry_53 = Geometry(<curve referenced from the Rhino model>)
point_38 = Point(<point referenced from the Rhino model>)
point_39 = Point(evaluate_surface_13.Point)
geometry_54 = Geometry(<brep referenced from the Rhino model>)
geometry_55 = Geometry(<curve referenced from the Rhino model>)
# Put the TRUNK to the surface
geometry_56 = Geometry(<mesh referenced from the Rhino model>)
evaluate_surface_14 = EvaluateSurface(Surface=surface_14, Point=construct_point_15)  # -> Point, Normal, UDirection, VDirection, Frame
geometry_57 = Geometry(<curve referenced from the Rhino model>)
geometry_58 = Geometry(<brep referenced from the Rhino model>)
# Put the TRUNK to the surface
geometry_59 = Geometry(<mesh referenced from the Rhino model>)
evaluate_surface_15 = EvaluateSurface(Surface=surface_15, Point=construct_point_16)  # -> Point, Normal, UDirection, VDirection, Frame
# Put the reference line to the surface
# (and correctly rotated/aligned)
orient_direction_25 = OrientDirection(Geometry=geometry_53, PointA=point_38, DirectionA=unit_vector, PointB=point_39, DirectionB=unit_vector_14)  # -> Geometry, Transform
transform_73 = Transform(Geometry=geometry_51, Transform=orient_direction_25.Transform)
transform_74 = Transform(Geometry=geometry_50, Transform=orient_direction_25.Transform)
# Put the reference line to the surface
# (and correctly rotated/aligned)
number_slider_71 = Slider(3, range=0..10)
unit_vector_15 = UnitVector(Vector=evaluate_surface_14.Normal)
geometry_60 = Geometry(<curve referenced from the Rhino model>)
point_40 = Point(<point referenced from the Rhino model>)
point_41 = Point(evaluate_surface_14.Point)
# t8
geometry_61 = Geometry(<curve referenced from the Rhino model>)
unit_vector_16 = UnitVector(Vector=evaluate_surface_15.Normal)
point_42 = Point(evaluate_surface_15.Point)
point_43 = Point(<point referenced from the Rhino model>)
orient_direction_26 = OrientDirection(
    Geometry=orient_direction_25.Geometry,
    PointA=point_39,
    DirectionA=orient_direction_25.Geometry,
    PointB=point_39,
    DirectionB=evaluate_surface_13.UDirection)  # -> Geometry, Transform
rotate_13 = Rotate(Geometry=orient_direction_26.Geometry, Angle=radians_13, Plane=evaluate_surface_13.Frame)  # -> Geometry, Transform
transform_75 = Transform(Geometry=transform_73, Transform=orient_direction_26.Transform)
transform_76 = Transform(Geometry=transform_74, Transform=orient_direction_26.Transform)
transform_77 = Transform(Geometry=transform_75, Transform=rotate_13.Transform)
transform_78 = Transform(Geometry=transform_76, Transform=rotate_13.Transform)
triangle_mapping_13 = TriangleMapping(Geometry=geometry_52, Source=geometry_50, Target=transform_78)  # -> Geometry, Transform
explode_13 = Explode(Curve=transform_78, Recursive=True)  # -> Segments, Vertices
list_item_52 = ListItem(List=explode_13.Vertices, Index=number_slider_71, Wrap=True)
list_item_53 = ListItem(List=explode_13.Vertices, Index=Slider(1, range=0..10), Wrap=True)
list_item_54 = ListItem(List=explode_13.Vertices, Index=Slider(2, range=0..10), Wrap=True)
# Put the reference line to the surface
# (and correctly rotated/aligned)
orient_direction_27 = OrientDirection(Geometry=geometry_60, PointA=point_40, DirectionA=unit_vector, PointB=point_41, DirectionB=unit_vector_15)  # -> Geometry, Transform
transform_79 = Transform(Geometry=geometry_54, Transform=orient_direction_27.Transform)
transform_80 = Transform(Geometry=geometry_55, Transform=orient_direction_27.Transform)
# Put the reference line to the surface
# (and correctly rotated/aligned)
orient_direction_28 = OrientDirection(Geometry=geometry_61, PointA=point_43, DirectionA=unit_vector, PointB=point_42, DirectionB=unit_vector_16)  # -> Geometry, Transform
transform_81 = Transform(Geometry=geometry_58, Transform=orient_direction_28.Transform)
transform_82 = Transform(Geometry=geometry_57, Transform=orient_direction_28.Transform)
removeduplicatepts_13 = RemoveDuplicatePts(Points=explode_13.Vertices, Tolerance=0.01)
orient_direction_29 = OrientDirection(
    Geometry=orient_direction_27.Geometry,
    PointA=point_41,
    DirectionA=orient_direction_27.Geometry,
    PointB=point_41,
    DirectionB=evaluate_surface_14.UDirection)  # -> Geometry, Transform
rotate_14 = Rotate(Geometry=orient_direction_29.Geometry, Angle=radians_14, Plane=evaluate_surface_14.Frame)  # -> Geometry, Transform
transform_83 = Transform(Geometry=transform_79, Transform=orient_direction_29.Transform)
transform_84 = Transform(Geometry=transform_80, Transform=orient_direction_29.Transform)
transform_85 = Transform(Geometry=transform_83, Transform=rotate_14.Transform)
transform_86 = Transform(Geometry=transform_84, Transform=rotate_14.Transform)
triangle_mapping_14 = TriangleMapping(Geometry=geometry_56, Source=geometry_55, Target=transform_86)  # -> Geometry, Transform
explode_14 = Explode(Curve=transform_86, Recursive=True)  # -> Segments, Vertices
list_item_55 = ListItem(List=explode_14.Vertices, Index=Slider(3, range=0..10), Wrap=True)
list_item_56 = ListItem(List=explode_14.Vertices, Index=Slider(1, range=0..10), Wrap=True)
list_item_57 = ListItem(List=explode_14.Vertices, Index=Slider(2, range=0..10), Wrap=True)
point_44 = Point(removeduplicatepts_13)
orient_direction_30 = OrientDirection(
    Geometry=orient_direction_28.Geometry,
    PointA=point_42,
    DirectionA=orient_direction_28.Geometry,
    PointB=point_42,
    DirectionB=evaluate_surface_15.UDirection)  # -> Geometry, Transform
rotate_15 = Rotate(Geometry=orient_direction_30.Geometry, Angle=radians_15, Plane=evaluate_surface_15.Frame)  # -> Geometry, Transform
transform_87 = Transform(Geometry=transform_81, Transform=orient_direction_30.Transform)
transform_88 = Transform(Geometry=transform_82, Transform=orient_direction_30.Transform)
transform_89 = Transform(Geometry=transform_87, Transform=rotate_15.Transform)
transform_90 = Transform(Geometry=transform_88, Transform=rotate_15.Transform)
triangle_mapping_15 = TriangleMapping(Geometry=geometry_59, Source=geometry_57, Target=transform_90)  # -> Geometry, Transform
explode_15 = Explode(Curve=transform_90, Recursive=True)  # -> Segments, Vertices
list_item_58 = ListItem(List=explode_15.Vertices, Index=Slider(3, range=0..10), Wrap=True)
list_item_59 = ListItem(List=explode_15.Vertices, Index=Slider(1, range=0..10), Wrap=True)
list_item_60 = ListItem(List=explode_15.Vertices, Index=Slider(2, range=0..10), Wrap=True)
removeduplicatepts_14 = RemoveDuplicatePts(Points=explode_14.Vertices, Tolerance=0.01)
removeduplicatepts_15 = RemoveDuplicatePts(Points=explode_15.Vertices, Tolerance=0.01)
point_45 = Point(removeduplicatepts_14)
point_46 = Point(removeduplicatepts_15)
number_slider_72 = Slider(0.448, range=0.4..0.5)
number_slider_73 = Slider(0.052, range=0.022..0.099)
number_slider_74 = Slider(1.319, range=-10..10)
list_item_61 = ListItem(List=jitter.Values, Index=Slider(5, range=0..100), Wrap=True)
number_slider_75 = Slider(0.044, range=0..0.1)
number_slider_76 = Slider(0.05, range=0.022..0.099)
number_of_trunk_per_row_16 = Slider(9, range=0..10)
number_slider_77 = Slider(1.712, range=-10..10)
number_slider_78 = Slider(0.05, range=0.022..0.099)
number_slider_79 = Slider(0.836, range=0.8..0.9)
number_slider_80 = Slider(1.688, range=-10..10)
list_item_62 = ListItem(List=jitter_2.Values, Index=Slider(5, range=0..100), Wrap=True)
list_item_63 = ListItem(List=jitter_3.Values, Index=Slider(5, range=0..100), Wrap=True)
division_16 = Division(A=list_item_61, B=number_of_trunk_per_row_16)
number_of_trunk_per_row_17 = Slider(9, range=0..10)
number_of_trunk_per_row_18 = Slider(9, range=0..10)
addition_21 = Addition(A=number_slider_73, B=division_16)
addition_22 = Addition(A=addition_21, B=Slider(0.05, range=0..0.1))
construct_point_17 = ConstructPoint(XCoordinate=number_slider_72, YCoordinate=addition_22, ZCoordinate=Slider(0, range=0..100))
radians_16 = Radians(Degrees=number_slider_74)
surface_16 = Surface(reparameterize(geometry_13))
division_17 = Division(A=list_item_62, B=number_of_trunk_per_row_17)
division_18 = Division(A=list_item_63, B=number_of_trunk_per_row_18)
addition_23 = Addition(A=number_slider_76, B=division_17)
geometry_62 = Geometry(<curve referenced from the Rhino model>)
geometry_63 = Geometry(<brep referenced from the Rhino model>)
# Put the reference line to the surface
# (and correctly rotated/aligned)
geometry_64 = Geometry(<mesh referenced from the Rhino model>)
evaluate_surface_16 = EvaluateSurface(Surface=surface_16, Point=construct_point_17)  # -> Point, Normal, UDirection, VDirection, Frame
addition_24 = Addition(A=number_slider_78, B=division_18)
construct_point_18 = ConstructPoint(XCoordinate=number_slider_75, YCoordinate=addition_23, ZCoordinate=Slider(0, range=0..100))
radians_17 = Radians(Degrees=number_slider_77)
surface_17 = Surface(reparameterize(geometry_13))
construct_point_19 = ConstructPoint(XCoordinate=number_slider_79, YCoordinate=addition_24, ZCoordinate=Slider(0, range=0..100))
radians_18 = Radians(Degrees=number_slider_80)
surface_18 = Surface(reparameterize(geometry_13))
unit_vector_17 = UnitVector(Vector=evaluate_surface_16.Normal)
geometry_65 = Geometry(<curve referenced from the Rhino model>)
point_47 = Point(<point referenced from the Rhino model>)
point_48 = Point(evaluate_surface_16.Point)
geometry_66 = Geometry(<curve referenced from the Rhino model>)
geometry_67 = Geometry(<brep referenced from the Rhino model>)
geometry_68 = Geometry(<mesh referenced from the Rhino model>)
evaluate_surface_17 = EvaluateSurface(Surface=surface_17, Point=construct_point_18)  # -> Point, Normal, UDirection, VDirection, Frame
geometry_69 = Geometry(<curve referenced from the Rhino model>)
geometry_70 = Geometry(<brep referenced from the Rhino model>)
geometry_71 = Geometry(<mesh referenced from the Rhino model>)
evaluate_surface_18 = EvaluateSurface(Surface=surface_18, Point=construct_point_19)  # -> Point, Normal, UDirection, VDirection, Frame
orient_direction_31 = OrientDirection(Geometry=geometry_65, PointA=point_47, DirectionA=unit_vector, PointB=point_48, DirectionB=unit_vector_17)  # -> Geometry, Transform
transform_91 = Transform(Geometry=geometry_63, Transform=orient_direction_31.Transform)
transform_92 = Transform(Geometry=geometry_62, Transform=orient_direction_31.Transform)
unit_vector_18 = UnitVector(Vector=evaluate_surface_17.Normal)
geometry_72 = Geometry(<curve referenced from the Rhino model>)
point_49 = Point(<point referenced from the Rhino model>)
point_50 = Point(evaluate_surface_17.Point)
unit_vector_19 = UnitVector(Vector=evaluate_surface_18.Normal)
geometry_73 = Geometry(<curve referenced from the Rhino model>)
point_51 = Point(<point referenced from the Rhino model>)
point_52 = Point(evaluate_surface_18.Point)
orient_direction_32 = OrientDirection(
    Geometry=orient_direction_31.Geometry,
    PointA=point_48,
    DirectionA=orient_direction_31.Geometry,
    PointB=point_48,
    DirectionB=evaluate_surface_16.UDirection)  # -> Geometry, Transform
rotate_16 = Rotate(Geometry=orient_direction_32.Geometry, Angle=radians_16, Plane=evaluate_surface_16.Frame)  # -> Geometry, Transform
transform_93 = Transform(Geometry=transform_91, Transform=orient_direction_32.Transform)
transform_94 = Transform(Geometry=transform_92, Transform=orient_direction_32.Transform)
transform_95 = Transform(Geometry=transform_93, Transform=rotate_16.Transform)
transform_96 = Transform(Geometry=transform_94, Transform=rotate_16.Transform)
triangle_mapping_16 = TriangleMapping(Geometry=geometry_64, Source=geometry_62, Target=transform_96)  # -> Geometry, Transform
explode_16 = Explode(Curve=transform_96, Recursive=True)  # -> Segments, Vertices
list_item_64 = ListItem(List=explode_16.Vertices, Index=Slider(3, range=0..10), Wrap=True)
list_item_65 = ListItem(List=explode_16.Vertices, Index=Slider(1, range=0..10), Wrap=True)
list_item_66 = ListItem(List=explode_16.Vertices, Index=Slider(2, range=0..10), Wrap=True)
orient_direction_33 = OrientDirection(Geometry=geometry_72, PointA=point_49, DirectionA=unit_vector, PointB=point_50, DirectionB=unit_vector_18)  # -> Geometry, Transform
transform_97 = Transform(Geometry=geometry_67, Transform=orient_direction_33.Transform)
transform_98 = Transform(Geometry=geometry_66, Transform=orient_direction_33.Transform)
orient_direction_34 = OrientDirection(Geometry=geometry_73, PointA=point_51, DirectionA=unit_vector, PointB=point_52, DirectionB=unit_vector_19)  # -> Geometry, Transform
transform_99 = Transform(Geometry=geometry_70, Transform=orient_direction_34.Transform)
transform_100 = Transform(Geometry=geometry_69, Transform=orient_direction_34.Transform)
removeduplicatepts_16 = RemoveDuplicatePts(Points=explode_16.Vertices, Tolerance=0.01)
orient_direction_35 = OrientDirection(
    Geometry=orient_direction_33.Geometry,
    PointA=point_50,
    DirectionA=orient_direction_33.Geometry,
    PointB=point_50,
    DirectionB=evaluate_surface_17.UDirection)  # -> Geometry, Transform
rotate_17 = Rotate(Geometry=orient_direction_35.Geometry, Angle=radians_17, Plane=evaluate_surface_17.Frame)  # -> Geometry, Transform
transform_101 = Transform(Geometry=transform_97, Transform=orient_direction_35.Transform)
transform_102 = Transform(Geometry=transform_98, Transform=orient_direction_35.Transform)
transform_103 = Transform(Geometry=transform_101, Transform=rotate_17.Transform)
transform_104 = Transform(Geometry=transform_102, Transform=rotate_17.Transform)
triangle_mapping_17 = TriangleMapping(Geometry=geometry_68, Source=geometry_66, Target=transform_104)  # -> Geometry, Transform
explode_17 = Explode(Curve=transform_104, Recursive=True)  # -> Segments, Vertices
list_item_67 = ListItem(List=explode_17.Vertices, Index=Slider(3, range=0..10), Wrap=True)
list_item_68 = ListItem(List=explode_17.Vertices, Index=Slider(1, range=0..10), Wrap=True)
list_item_69 = ListItem(List=explode_17.Vertices, Index=Slider(2, range=0..10), Wrap=True)
point_53 = Point(removeduplicatepts_16)
orient_direction_36 = OrientDirection(
    Geometry=orient_direction_34.Geometry,
    PointA=point_52,
    DirectionA=orient_direction_34.Geometry,
    PointB=point_52,
    DirectionB=evaluate_surface_18.UDirection)  # -> Geometry, Transform
rotate_18 = Rotate(Geometry=orient_direction_36.Geometry, Angle=radians_18, Plane=evaluate_surface_18.Frame)  # -> Geometry, Transform
transform_105 = Transform(Geometry=transform_99, Transform=orient_direction_36.Transform)
transform_106 = Transform(Geometry=transform_100, Transform=orient_direction_36.Transform)
transform_107 = Transform(Geometry=transform_105, Transform=rotate_18.Transform)
transform_108 = Transform(Geometry=transform_106, Transform=rotate_18.Transform)
triangle_mapping_18 = TriangleMapping(Geometry=geometry_71, Source=geometry_69, Target=transform_108)  # -> Geometry, Transform
explode_18 = Explode(Curve=transform_108, Recursive=True)  # -> Segments, Vertices
list_item_70 = ListItem(List=explode_18.Vertices, Index=Slider(3, range=0..10), Wrap=True)
list_item_71 = ListItem(List=explode_18.Vertices, Index=Slider(1, range=0..10), Wrap=True)
list_item_72 = ListItem(List=explode_18.Vertices, Index=Slider(2, range=0..10), Wrap=True)
removeduplicatepts_17 = RemoveDuplicatePts(Points=explode_17.Vertices, Tolerance=0.01)
removeduplicatepts_18 = RemoveDuplicatePts(Points=explode_18.Vertices, Tolerance=0.01)
point_54 = Point(removeduplicatepts_17)
point_55 = Point(removeduplicatepts_18)
number_slider_81 = Slider(0.457, range=0.4..0.5)
number_slider_82 = Slider(0.053, range=0.022..0.099)
number_slider_83 = Slider(-1.099, range=-10..10)
list_item_73 = ListItem(List=jitter.Values, Index=Slider(6, range=0..100), Wrap=True)
number_slider_84 = Slider(0.033, range=0..0.1)
number_slider_85 = Slider(0.055, range=0.022..0.099)
number_of_trunk_per_row_19 = Slider(9, range=0..10)
number_slider_86 = Slider(0.446, range=-10..10)
number_slider_87 = Slider(1.326, range=1..1.5)
number_slider_88 = Slider(0.064, range=0.022..0.099)
number_slider_89 = Slider(2.8, range=-10..10)
list_item_74 = ListItem(List=jitter_2.Values, Index=Slider(6, range=0..100), Wrap=True)
list_item_75 = ListItem(List=jitter_3.Values, Index=Slider(69, range=0..100), Wrap=True)
division_19 = Division(A=list_item_73, B=number_of_trunk_per_row_19)
number_of_trunk_per_row_20 = Slider(9, range=0..10)
number_of_trunk_per_row_21 = Slider(9, range=0..10)
addition_25 = Addition(A=number_slider_82, B=division_19)
addition_26 = Addition(A=addition_25, B=Slider(0.05, range=0..0.1))
construct_point_20 = ConstructPoint(XCoordinate=number_slider_81, YCoordinate=addition_26, ZCoordinate=Slider(0, range=0..100))
radians_19 = Radians(Degrees=number_slider_83)
surface_19 = Surface(reparameterize(geometry_13))
division_20 = Division(A=list_item_74, B=number_of_trunk_per_row_20)
division_21 = Division(A=list_item_75, B=number_of_trunk_per_row_21)
addition_27 = Addition(A=number_slider_85, B=division_20)
geometry_74 = Geometry(<curve referenced from the Rhino model>)
geometry_75 = Geometry(<brep referenced from the Rhino model>)
geometry_76 = Geometry(<mesh referenced from the Rhino model>)
evaluate_surface_19 = EvaluateSurface(Surface=surface_19, Point=construct_point_20)  # -> Point, Normal, UDirection, VDirection, Frame
addition_28 = Addition(A=number_slider_88, B=division_21)
construct_point_21 = ConstructPoint(XCoordinate=number_slider_84, YCoordinate=addition_27, ZCoordinate=Slider(0, range=0..100))
radians_20 = Radians(Degrees=number_slider_86)
surface_20 = Surface(reparameterize(geometry_13))
construct_point_22 = ConstructPoint(XCoordinate=number_slider_87, YCoordinate=addition_28, ZCoordinate=Slider(0, range=0..100))
radians_21 = Radians(Degrees=number_slider_89)
surface_21 = Surface(reparameterize(geometry_13))
unit_vector_20 = UnitVector(Vector=evaluate_surface_19.Normal)
geometry_77 = Geometry(<curve referenced from the Rhino model>)
point_56 = Point(<point referenced from the Rhino model>)
point_57 = Point(evaluate_surface_19.Point)
geometry_78 = Geometry(<curve referenced from the Rhino model>)
geometry_79 = Geometry(<brep referenced from the Rhino model>)
geometry_80 = Geometry(<mesh referenced from the Rhino model>)
evaluate_surface_20 = EvaluateSurface(Surface=surface_20, Point=construct_point_21)  # -> Point, Normal, UDirection, VDirection, Frame
geometry_81 = Geometry(<curve referenced from the Rhino model>)
geometry_82 = Geometry(<brep referenced from the Rhino model>)
geometry_83 = Geometry(<mesh referenced from the Rhino model>)
# T7
evaluate_surface_21 = EvaluateSurface(Surface=surface_21, Point=construct_point_22)  # -> Point, Normal, UDirection, VDirection, Frame
orient_direction_37 = OrientDirection(Geometry=geometry_77, PointA=point_56, DirectionA=unit_vector, PointB=point_57, DirectionB=unit_vector_20)  # -> Geometry, Transform
transform_109 = Transform(Geometry=geometry_75, Transform=orient_direction_37.Transform)
transform_110 = Transform(Geometry=geometry_74, Transform=orient_direction_37.Transform)
txt = Text()
unit_vector_21 = UnitVector(Vector=evaluate_surface_20.Normal)
geometry_84 = Geometry(<curve referenced from the Rhino model>)
point_58 = Point(<point referenced from the Rhino model>)
point_59 = Point(evaluate_surface_20.Point)
unit_vector_22 = UnitVector(Vector=evaluate_surface_21.Normal)
geometry_85 = Geometry(<curve referenced from the Rhino model>)
point_60 = Point(<point referenced from the Rhino model>)
point_61 = Point(evaluate_surface_21.Point)
orient_direction_38 = OrientDirection(
    Geometry=orient_direction_37.Geometry,
    PointA=point_57,
    DirectionA=orient_direction_37.Geometry,
    PointB=point_57,
    DirectionB=evaluate_surface_19.UDirection)  # -> Geometry, Transform
rotate_19 = Rotate(Geometry=orient_direction_38.Geometry, Angle=radians_19, Plane=evaluate_surface_19.Frame)  # -> Geometry, Transform
transform_111 = Transform(Geometry=transform_109, Transform=orient_direction_38.Transform)
transform_112 = Transform(Geometry=transform_110, Transform=orient_direction_38.Transform)
transform_113 = Transform(Geometry=transform_111, Transform=rotate_19.Transform)
transform_114 = Transform(Geometry=transform_112, Transform=rotate_19.Transform)
triangle_mapping_19 = TriangleMapping(Geometry=geometry_76, Source=geometry_74, Target=transform_114)  # -> Geometry, Transform
explode_19 = Explode(Curve=transform_114, Recursive=True)  # -> Segments, Vertices
# Put the reference line to the surface
# (and correctly rotated/aligned)
list_item_76 = ListItem(List=explode_19.Vertices, Index=Slider(3, range=0..10), Wrap=True)
list_item_77 = ListItem(List=explode_19.Vertices, Index=Slider(1, range=0..10), Wrap=True)
list_item_78 = ListItem(List=explode_19.Vertices, Index=Slider(2, range=0..10), Wrap=True)
orient_direction_39 = OrientDirection(Geometry=geometry_84, PointA=point_58, DirectionA=unit_vector, PointB=point_59, DirectionB=unit_vector_21)  # -> Geometry, Transform
transform_115 = Transform(Geometry=geometry_79, Transform=orient_direction_39.Transform)
transform_116 = Transform(Geometry=geometry_78, Transform=orient_direction_39.Transform)
orient_direction_40 = OrientDirection(Geometry=geometry_85, PointA=point_60, DirectionA=unit_vector, PointB=point_61, DirectionB=unit_vector_22)  # -> Geometry, Transform
transform_117 = Transform(Geometry=geometry_82, Transform=orient_direction_40.Transform)
transform_118 = Transform(Geometry=geometry_81, Transform=orient_direction_40.Transform)
removeduplicatepts_19 = RemoveDuplicatePts(Points=explode_19.Vertices, Tolerance=0.01)
orient_direction_41 = OrientDirection(
    Geometry=orient_direction_39.Geometry,
    PointA=point_59,
    DirectionA=orient_direction_39.Geometry,
    PointB=point_59,
    DirectionB=evaluate_surface_20.UDirection)  # -> Geometry, Transform
rotate_20 = Rotate(Geometry=orient_direction_41.Geometry, Angle=radians_20, Plane=evaluate_surface_20.Frame)  # -> Geometry, Transform
transform_119 = Transform(Geometry=transform_115, Transform=orient_direction_41.Transform)
transform_120 = Transform(Geometry=transform_116, Transform=orient_direction_41.Transform)
transform_121 = Transform(Geometry=transform_119, Transform=rotate_20.Transform)
transform_122 = Transform(Geometry=transform_120, Transform=rotate_20.Transform)
triangle_mapping_20 = TriangleMapping(Geometry=geometry_80, Source=geometry_78, Target=transform_122)  # -> Geometry, Transform
explode_20 = Explode(Curve=transform_122, Recursive=True)  # -> Segments, Vertices
list_item_79 = ListItem(List=explode_20.Vertices, Index=Slider(3, range=0..10), Wrap=True)
list_item_80 = ListItem(List=explode_20.Vertices, Index=Slider(1, range=0..10), Wrap=True)
list_item_81 = ListItem(List=explode_20.Vertices, Index=Slider(2, range=0..10), Wrap=True)
point_62 = Point(removeduplicatepts_19)
orient_direction_42 = OrientDirection(
    Geometry=orient_direction_40.Geometry,
    PointA=point_61,
    DirectionA=orient_direction_40.Geometry,
    PointB=point_61,
    DirectionB=evaluate_surface_21.UDirection)  # -> Geometry, Transform
rotate_21 = Rotate(Geometry=orient_direction_42.Geometry, Angle=radians_21, Plane=evaluate_surface_21.Frame)  # -> Geometry, Transform
transform_123 = Transform(Geometry=transform_117, Transform=orient_direction_42.Transform)
transform_124 = Transform(Geometry=transform_118, Transform=orient_direction_42.Transform)
transform_125 = Transform(Geometry=transform_123, Transform=rotate_21.Transform)
transform_126 = Transform(Geometry=transform_124, Transform=rotate_21.Transform)
triangle_mapping_21 = TriangleMapping(Geometry=geometry_83, Source=geometry_81, Target=transform_126)  # -> Geometry, Transform
explode_21 = Explode(Curve=transform_126, Recursive=True)  # -> Segments, Vertices
list_item_82 = ListItem(List=explode_21.Vertices, Index=Slider(3, range=0..10), Wrap=True)
list_item_83 = ListItem(List=explode_21.Vertices, Index=Slider(1, range=0..10), Wrap=True)
list_item_84 = ListItem(List=explode_21.Vertices, Index=Slider(2, range=0..10), Wrap=True)
removeduplicatepts_20 = RemoveDuplicatePts(Points=explode_20.Vertices, Tolerance=0.01)
removeduplicatepts_21 = RemoveDuplicatePts(Points=explode_21.Vertices, Tolerance=0.01)
point_63 = Point(removeduplicatepts_20)
point_64 = Point(removeduplicatepts_21)
number_slider_90 = Slider(0.448, range=0.4..0.5)
number_slider_91 = Slider(0.059, range=0.022..0.099)
number_slider_92 = Slider(-0.113, range=-10..10)
list_item_85 = ListItem(List=jitter.Values, Index=Slider(7, range=0..100), Wrap=True)
number_slider_93 = Slider(0.042, range=0..0.1)
number_slider_94 = Slider(0.057, range=0.022..0.099)
number_of_trunk_per_row_22 = Slider(9, range=0..10)
number_slider_95 = Slider(1.18, range=-10..10)
number_slider_96 = Slider(0.841, range=0.8..0.9)
number_slider_97 = Slider(0.052, range=0.022..0.099)
number_slider_98 = Slider(-3.583, range=-10..10)
list_item_86 = ListItem(List=jitter_2.Values, Index=Slider(7, range=0..100), Wrap=True)
# Put the reference triangle to the surface
# Put the triangle to the surface
#  (to calculate collision)
number_slider_99 = Slider(0.05, range=0..0.1)
list_item_87 = ListItem(List=jitter_3.Values, Index=Slider(7, range=0..100), Wrap=True)
# Variables for target location
# and slight rotation allowed
division_22 = Division(A=list_item_85, B=number_of_trunk_per_row_22)
number_of_trunk_per_row_23 = Slider(9, range=0..10)
number_of_trunk_per_row_24 = Slider(9, range=0..10)
addition_29 = Addition(A=number_slider_91, B=division_22)
addition_30 = Addition(A=addition_29, B=number_slider_99)
construct_point_23 = ConstructPoint(XCoordinate=number_slider_90, YCoordinate=addition_30, ZCoordinate=Slider(0, range=0..100))
radians_22 = Radians(Degrees=number_slider_92)
# Random Point on a Surface
surface_22 = Surface(reparameterize(geometry_13))
# Put the reference triangle to the surface
# Put the triangle to the surface
#  (to calculate collision)
division_23 = Division(A=list_item_86, B=number_of_trunk_per_row_23)
# Variables for target location
# and slight rotation allowed
number_slider_100 = Slider(0, range=0..100)
# Variables for target location
# and slight rotation allowed
# Put the reference triangle to the surface
# Put the triangle to the surface
#  (to calculate collision)
division_24 = Division(A=list_item_87, B=number_of_trunk_per_row_24)
addition_31 = Addition(A=number_slider_94, B=division_23)
geometry_86 = Geometry(<curve referenced from the Rhino model>)
geometry_87 = Geometry(<brep referenced from the Rhino model>)
# Put the TRUNK to the surface
geometry_88 = Geometry(<mesh referenced from the Rhino model>)
evaluate_surface_22 = EvaluateSurface(Surface=surface_22, Point=construct_point_23)  # -> Point, Normal, UDirection, VDirection, Frame
addition_32 = Addition(A=number_slider_97, B=division_24)
construct_point_24 = ConstructPoint(XCoordinate=number_slider_93, YCoordinate=addition_31, ZCoordinate=number_slider_100)
radians_23 = Radians(Degrees=number_slider_95)
# Random Point on a Surface
surface_23 = Surface(reparameterize(geometry_13))
construct_point_25 = ConstructPoint(XCoordinate=number_slider_96, YCoordinate=addition_32, ZCoordinate=Slider(0, range=0..100))
radians_24 = Radians(Degrees=number_slider_98)
# Random Point on a Surface
surface_24 = Surface(reparameterize(geometry_13))
unit_vector_23 = UnitVector(Vector=evaluate_surface_22.Normal)
geometry_89 = Geometry(<curve referenced from the Rhino model>)
point_65 = Point(<point referenced from the Rhino model>)
point_66 = Point(evaluate_surface_22.Point)
geometry_90 = Geometry(<curve referenced from the Rhino model>)
geometry_91 = Geometry(<brep referenced from the Rhino model>)
# Put the TRUNK to the surface
geometry_92 = Geometry(<mesh referenced from the Rhino model>)
evaluate_surface_23 = EvaluateSurface(Surface=surface_23, Point=construct_point_24)  # -> Point, Normal, UDirection, VDirection, Frame
geometry_93 = Geometry(<curve referenced from the Rhino model>)
geometry_94 = Geometry(<brep referenced from the Rhino model>)
# Put the TRUNK to the surface
geometry_95 = Geometry(<mesh referenced from the Rhino model>)
evaluate_surface_24 = EvaluateSurface(Surface=surface_24, Point=construct_point_25)  # -> Point, Normal, UDirection, VDirection, Frame
# Put the reference line to the surface
# (and correctly rotated/aligned)
orient_direction_43 = OrientDirection(Geometry=geometry_89, PointA=point_65, DirectionA=unit_vector, PointB=point_66, DirectionB=unit_vector_23)  # -> Geometry, Transform
transform_127 = Transform(Geometry=geometry_87, Transform=orient_direction_43.Transform)
transform_128 = Transform(Geometry=geometry_86, Transform=orient_direction_43.Transform)
unit_vector_24 = UnitVector(Vector=evaluate_surface_23.Normal)
geometry_96 = Geometry(<curve referenced from the Rhino model>)
point_67 = Point(<point referenced from the Rhino model>)
point_68 = Point(evaluate_surface_23.Point)
unit_vector_25 = UnitVector(Vector=evaluate_surface_24.Normal)
geometry_97 = Geometry(<curve referenced from the Rhino model>)
point_69 = Point(<point referenced from the Rhino model>)
point_70 = Point(evaluate_surface_24.Point)
orient_direction_44 = OrientDirection(
    Geometry=orient_direction_43.Geometry,
    PointA=point_66,
    DirectionA=orient_direction_43.Geometry,
    PointB=point_66,
    DirectionB=evaluate_surface_22.UDirection)  # -> Geometry, Transform
rotate_22 = Rotate(Geometry=orient_direction_44.Geometry, Angle=radians_22, Plane=evaluate_surface_22.Frame)  # -> Geometry, Transform
transform_129 = Transform(Geometry=transform_127, Transform=orient_direction_44.Transform)
transform_130 = Transform(Geometry=transform_128, Transform=orient_direction_44.Transform)
transform_131 = Transform(Geometry=transform_129, Transform=rotate_22.Transform)
transform_132 = Transform(Geometry=transform_130, Transform=rotate_22.Transform)
triangle_mapping_22 = TriangleMapping(Geometry=geometry_88, Source=geometry_86, Target=transform_132)  # -> Geometry, Transform
explode_22 = Explode(Curve=transform_132, Recursive=True)  # -> Segments, Vertices
list_item_88 = ListItem(List=explode_22.Vertices, Index=Slider(3, range=0..10), Wrap=True)
list_item_89 = ListItem(List=explode_22.Vertices, Index=Slider(1, range=0..10), Wrap=True)
list_item_90 = ListItem(List=explode_22.Vertices, Index=Slider(2, range=0..10), Wrap=True)
# Put the reference line to the surface
# (and correctly rotated/aligned)
orient_direction_45 = OrientDirection(Geometry=geometry_96, PointA=point_67, DirectionA=unit_vector, PointB=point_68, DirectionB=unit_vector_24)  # -> Geometry, Transform
transform_133 = Transform(Geometry=geometry_91, Transform=orient_direction_45.Transform)
transform_134 = Transform(Geometry=geometry_90, Transform=orient_direction_45.Transform)
# Put the reference line to the surface
# (and correctly rotated/aligned)
orient_direction_46 = OrientDirection(Geometry=geometry_97, PointA=point_69, DirectionA=unit_vector, PointB=point_70, DirectionB=unit_vector_25)  # -> Geometry, Transform
transform_135 = Transform(Geometry=geometry_94, Transform=orient_direction_46.Transform)
transform_136 = Transform(Geometry=geometry_93, Transform=orient_direction_46.Transform)
removeduplicatepts_22 = RemoveDuplicatePts(Points=explode_22.Vertices, Tolerance=0.01)
orient_direction_47 = OrientDirection(
    Geometry=orient_direction_45.Geometry,
    PointA=point_68,
    DirectionA=orient_direction_45.Geometry,
    PointB=point_68,
    DirectionB=evaluate_surface_23.UDirection)  # -> Geometry, Transform
rotate_23 = Rotate(Geometry=orient_direction_47.Geometry, Angle=radians_23, Plane=evaluate_surface_23.Frame)  # -> Geometry, Transform
transform_137 = Transform(Geometry=transform_133, Transform=orient_direction_47.Transform)
transform_138 = Transform(Geometry=transform_134, Transform=orient_direction_47.Transform)
transform_139 = Transform(Geometry=transform_137, Transform=rotate_23.Transform)
transform_140 = Transform(Geometry=transform_138, Transform=rotate_23.Transform)
triangle_mapping_23 = TriangleMapping(Geometry=geometry_92, Source=geometry_90, Target=transform_140)  # -> Geometry, Transform
explode_23 = Explode(Curve=transform_140, Recursive=True)  # -> Segments, Vertices
list_item_91 = ListItem(List=explode_23.Vertices, Index=Slider(1, range=0..10), Wrap=True)
list_item_92 = ListItem(List=explode_23.Vertices, Index=Slider(2, range=0..10), Wrap=True)
point_71 = Point(removeduplicatepts_22)
orient_direction_48 = OrientDirection(
    Geometry=orient_direction_46.Geometry,
    PointA=point_70,
    DirectionA=orient_direction_46.Geometry,
    PointB=point_70,
    DirectionB=evaluate_surface_24.UDirection)  # -> Geometry, Transform
rotate_24 = Rotate(Geometry=orient_direction_48.Geometry, Angle=radians_24, Plane=evaluate_surface_24.Frame)  # -> Geometry, Transform
transform_141 = Transform(Geometry=transform_135, Transform=orient_direction_48.Transform)
transform_142 = Transform(Geometry=transform_136, Transform=orient_direction_48.Transform)
transform_143 = Transform(Geometry=transform_141, Transform=rotate_24.Transform)
transform_144 = Transform(Geometry=transform_142, Transform=rotate_24.Transform)
triangle_mapping_24 = TriangleMapping(Geometry=geometry_95, Source=geometry_93, Target=transform_144)  # -> Geometry, Transform
explode_24 = Explode(Curve=transform_144, Recursive=True)  # -> Segments, Vertices
list_item_93 = ListItem(List=explode_24.Vertices, Index=Slider(3, range=0..10), Wrap=True)
list_item_94 = ListItem(List=explode_24.Vertices, Index=Slider(1, range=0..10), Wrap=True)
list_item_95 = ListItem(List=explode_23.Vertices, Index=Slider(3, range=0..10), Wrap=True)
list_item_96 = ListItem(List=explode_24.Vertices, Index=Slider(2, range=0..10), Wrap=True)
removeduplicatepts_23 = RemoveDuplicatePts(Points=explode_23.Vertices, Tolerance=0.01)
removeduplicatepts_24 = RemoveDuplicatePts(Points=explode_24.Vertices, Tolerance=0.01)
point_72 = Point(removeduplicatepts_23)
point_73 = Point(removeduplicatepts_24)
number_slider_101 = Slider(0.432, range=0.4..0.5)
number_slider_102 = Slider(0.056, range=0.022..0.099)
number_slider_103 = Slider(3.009, range=-10..10)
list_item_97 = ListItem(List=jitter.Values, Index=Slider(8, range=0..100), Wrap=True)
number_slider_104 = Slider(0.042, range=0..0.1)
number_slider_105 = Slider(0.051, range=0.022..0.099)
number_of_trunk_per_row_25 = Slider(9, range=0..10)
number_slider_106 = Slider(-0.236, range=-10..10)
number_slider_107 = Slider(-0.64, range=-10..10)
number_slider_108 = Slider(0.85, range=0.8..0.9)
number_slider_109 = Slider(0.059, range=0.022..0.099)
# Put the reference triangle to the surface
# Put the triangle to the surface
#  (to calculate collision)
number_slider_110 = Slider(0.05, range=0..0.1)
list_item_98 = ListItem(List=jitter_2.Values, Index=Slider(8, range=0..100), Wrap=True)
list_item_99 = ListItem(List=jitter_3.Values, Index=Slider(8, range=0..100), Wrap=True)
# Variables for target location
# and slight rotation allowed
division_25 = Division(A=list_item_97, B=number_of_trunk_per_row_25)
number_of_trunk_per_row_26 = Slider(9, range=0..10)
number_of_trunk_per_row_27 = Slider(9, range=0..10)
addition_33 = Addition(A=number_slider_102, B=division_25)
addition_34 = Addition(A=addition_33, B=number_slider_110)
construct_point_26 = ConstructPoint(XCoordinate=number_slider_101, YCoordinate=addition_34, ZCoordinate=Slider(0, range=0..100))
radians_25 = Radians(Degrees=number_slider_103)
# Random Point on a Surface
surface_25 = Surface(reparameterize(geometry_13))
# Put the reference triangle to the surface
# Put the triangle to the surface
#  (to calculate collision)
division_26 = Division(A=list_item_98, B=number_of_trunk_per_row_26)
# Variables for target location
# and slight rotation allowed
number_slider_111 = Slider(0, range=0..100)
# Variables for target location
# and slight rotation allowed
# Put the reference triangle to the surface
# Put the triangle to the surface
#  (to calculate collision)
division_27 = Division(A=list_item_99, B=number_of_trunk_per_row_27)
addition_35 = Addition(A=number_slider_105, B=division_26)
geometry_98 = Geometry(<curve referenced from the Rhino model>)
geometry_99 = Geometry(<brep referenced from the Rhino model>)
# Put the TRUNK to the surface
geometry_100 = Geometry(<mesh referenced from the Rhino model>)
evaluate_surface_25 = EvaluateSurface(Surface=surface_25, Point=construct_point_26)  # -> Point, Normal, UDirection, VDirection, Frame
addition_36 = Addition(A=number_slider_109, B=division_27)
construct_point_27 = ConstructPoint(XCoordinate=number_slider_104, YCoordinate=addition_35, ZCoordinate=number_slider_111)
radians_26 = Radians(Degrees=number_slider_106)
# Random Point on a Surface
surface_26 = Surface(reparameterize(geometry_13))
construct_point_28 = ConstructPoint(XCoordinate=number_slider_108, YCoordinate=addition_36, ZCoordinate=Slider(0, range=0..100))
radians_27 = Radians(Degrees=number_slider_107)
# Random Point on a Surface
surface_27 = Surface(reparameterize(geometry_13))
unit_vector_26 = UnitVector(Vector=evaluate_surface_25.Normal)
geometry_101 = Geometry(<curve referenced from the Rhino model>)
point_74 = Point(<point referenced from the Rhino model>)
point_75 = Point(evaluate_surface_25.Point)
geometry_102 = Geometry(<curve referenced from the Rhino model>)
geometry_103 = Geometry(<brep referenced from the Rhino model>)
# Put the TRUNK to the surface
geometry_104 = Geometry(<mesh referenced from the Rhino model>)
evaluate_surface_26 = EvaluateSurface(Surface=surface_26, Point=construct_point_27)  # -> Point, Normal, UDirection, VDirection, Frame
geometry_105 = Geometry(<brep referenced from the Rhino model>)
geometry_106 = Geometry(<curve referenced from the Rhino model>)
# Put the TRUNK to the surface
geometry_107 = Geometry(<mesh referenced from the Rhino model>)
evaluate_surface_27 = EvaluateSurface(Surface=surface_27, Point=construct_point_28)  # -> Point, Normal, UDirection, VDirection, Frame
# Put the reference line to the surface
# (and correctly rotated/aligned)
orient_direction_49 = OrientDirection(Geometry=geometry_101, PointA=point_74, DirectionA=unit_vector, PointB=point_75, DirectionB=unit_vector_26)  # -> Geometry, Transform
transform_145 = Transform(Geometry=geometry_99, Transform=orient_direction_49.Transform)
transform_146 = Transform(Geometry=geometry_98, Transform=orient_direction_49.Transform)
unit_vector_27 = UnitVector(Vector=evaluate_surface_26.Normal)
geometry_108 = Geometry(<curve referenced from the Rhino model>)
point_76 = Point(<point referenced from the Rhino model>)
point_77 = Point(evaluate_surface_26.Point)
unit_vector_28 = UnitVector(Vector=evaluate_surface_27.Normal)
geometry_109 = Geometry(<curve referenced from the Rhino model>)
point_78 = Point(<point referenced from the Rhino model>)
point_79 = Point(evaluate_surface_27.Point)
orient_direction_50 = OrientDirection(
    Geometry=orient_direction_49.Geometry,
    PointA=point_75,
    DirectionA=orient_direction_49.Geometry,
    PointB=point_75,
    DirectionB=evaluate_surface_25.UDirection)  # -> Geometry, Transform
rotate_25 = Rotate(Geometry=orient_direction_50.Geometry, Angle=radians_25, Plane=evaluate_surface_25.Frame)  # -> Geometry, Transform
transform_147 = Transform(Geometry=transform_145, Transform=orient_direction_50.Transform)
transform_148 = Transform(Geometry=transform_146, Transform=orient_direction_50.Transform)
transform_149 = Transform(Geometry=transform_147, Transform=rotate_25.Transform)
geometry_110 = Geometry([transform_131, transform_149, transform_113, transform_95, transform_77, transform_59, transform_41, transform_23, transform_5])
transform_150 = Transform(Geometry=transform_148, Transform=rotate_25.Transform)
triangle_mapping_25 = TriangleMapping(Geometry=geometry_100, Source=geometry_98, Target=transform_150)  # -> Geometry, Transform
mesh = Mesh([triangle_mapping_19.Geometry, triangle_mapping_22.Geometry, triangle_mapping_25.Geometry, triangle_mapping_16.Geometry, triangle_mapping_13.Geometry, triangle_mapping_10.Geometry, triangle_mapping_7.Geometry, triangle_mapping_4.Geometry, triangle_mapping.Geometry])
explode_25 = Explode(Curve=transform_150, Recursive=True)  # -> Segments, Vertices
list_item_100 = ListItem(List=explode_25.Vertices, Index=Slider(3, range=0..10), Wrap=True)
point_80 = Point([list_item_4, list_item_16, list_item_28, list_item_40, list_item_52, list_item_64, list_item_76, list_item_88, list_item_100])
list_item_101 = ListItem(List=explode_25.Vertices, Index=Slider(1, range=0..10), Wrap=True)
point_81 = Point([list_item_5, list_item_17, list_item_29, list_item_41, list_item_53, list_item_65, list_item_77, list_item_89, list_item_101])
list_item_102 = ListItem(List=explode_25.Vertices, Index=Slider(2, range=0..10), Wrap=True)
point_82 = Point([list_item_6, list_item_18, list_item_30, list_item_42, list_item_54, list_item_66, list_item_78, list_item_90, list_item_102])
closest_points = ClosestPoints(Point=point_81, Cloud=point_82, Count=Slider(1, range=0..1))  # -> ClosestPoint, CPIndex, flatten(Distance)
number = Number(closest_points.Distance)
# Put the reference line to the surface
# (and correctly rotated/aligned)
orient_direction_51 = OrientDirection(Geometry=geometry_108, PointA=point_76, DirectionA=unit_vector, PointB=point_77, DirectionB=unit_vector_27)  # -> Geometry, Transform
transform_151 = Transform(Geometry=geometry_103, Transform=orient_direction_51.Transform)
transform_152 = Transform(Geometry=geometry_102, Transform=orient_direction_51.Transform)
# Put the reference line to the surface
# (and correctly rotated/aligned)
orient_direction_52 = OrientDirection(Geometry=geometry_109, PointA=point_78, DirectionA=unit_vector, PointB=point_79, DirectionB=unit_vector_28)  # -> Geometry, Transform
transform_153 = Transform(Geometry=geometry_105, Transform=orient_direction_52.Transform)
transform_154 = Transform(Geometry=geometry_106, Transform=orient_direction_52.Transform)
removeduplicatepts_25 = RemoveDuplicatePts(Points=explode_25.Vertices, Tolerance=0.01)
orient_direction_53 = OrientDirection(
    Geometry=orient_direction_51.Geometry,
    PointA=point_77,
    DirectionA=orient_direction_51.Geometry,
    PointB=point_77,
    DirectionB=evaluate_surface_26.UDirection)  # -> Geometry, Transform
rotate_26 = Rotate(Geometry=orient_direction_53.Geometry, Angle=radians_26, Plane=evaluate_surface_26.Frame)  # -> Geometry, Transform
transform_155 = Transform(Geometry=transform_151, Transform=orient_direction_53.Transform)
transform_156 = Transform(Geometry=transform_152, Transform=orient_direction_53.Transform)
transform_157 = Transform(Geometry=transform_155, Transform=rotate_26.Transform)
geometry_111 = Geometry([transform_139, transform_157, transform_121, transform_103, transform_85, transform_67, transform_49, transform_31, transform_13])
transform_158 = Transform(Geometry=transform_156, Transform=rotate_26.Transform)
triangle_mapping_26 = TriangleMapping(Geometry=geometry_104, Source=geometry_102, Target=transform_158)  # -> Geometry, Transform
mesh_2 = Mesh([triangle_mapping_20.Geometry, triangle_mapping_23.Geometry, triangle_mapping_26.Geometry, triangle_mapping_17.Geometry, triangle_mapping_14.Geometry, triangle_mapping_11.Geometry, triangle_mapping_8.Geometry, triangle_mapping_5.Geometry, triangle_mapping_2.Geometry])
explode_26 = Explode(Curve=transform_158, Recursive=True)  # -> Segments, Vertices
list_item_103 = ListItem(List=explode_26.Vertices, Index=Slider(3, range=0..10), Wrap=True)
point_83 = Point([list_item_7, list_item_19, list_item_31, list_item_43, list_item_55, list_item_67, list_item_79, list_item_95, list_item_103])
closest_points_2 = ClosestPoints(Point=point_83, Cloud=point_81, Count=Slider(1, range=0..1))  # -> ClosestPoint, CPIndex, flatten(Distance)
number_2 = Number(closest_points_2.Distance)
list_item_104 = ListItem(List=explode_26.Vertices, Index=Slider(1, range=0..10), Wrap=True)
point_84 = Point([list_item_8, list_item_20, list_item_32, list_item_44, list_item_56, list_item_68, list_item_80, list_item_91, list_item_104])
list_item_105 = ListItem(List=explode_26.Vertices, Index=Slider(2, range=0..10), Wrap=True)
point_85 = Point([list_item_9, list_item_21, list_item_33, list_item_45, list_item_57, list_item_69, list_item_81, list_item_92, list_item_105])
closest_points_3 = ClosestPoints(Point=point_84, Cloud=point_85, Count=Slider(1, range=0..1))  # -> ClosestPoint, CPIndex, flatten(Distance)
number_3 = Number(closest_points_3.Distance)
point_86 = Point(removeduplicatepts_25)
orient_direction_54 = OrientDirection(
    Geometry=orient_direction_52.Geometry,
    PointA=point_79,
    DirectionA=orient_direction_52.Geometry,
    PointB=point_79,
    DirectionB=evaluate_surface_27.UDirection)  # -> Geometry, Transform
rotate_27 = Rotate(Geometry=orient_direction_54.Geometry, Angle=radians_27, Plane=evaluate_surface_27.Frame)  # -> Geometry, Transform
transform_159 = Transform(Geometry=transform_153, Transform=orient_direction_54.Transform)
transform_160 = Transform(Geometry=transform_154, Transform=orient_direction_54.Transform)
transform_161 = Transform(Geometry=transform_159, Transform=rotate_27.Transform)
transform_162 = Transform(Geometry=transform_160, Transform=rotate_27.Transform)
triangle_mapping_27 = TriangleMapping(Geometry=geometry_107, Source=geometry_106, Target=transform_162)  # -> Geometry, Transform
explode_27 = Explode(Curve=transform_162, Recursive=True)  # -> Segments, Vertices
list_item_106 = ListItem(List=explode_27.Vertices, Index=Slider(3, range=0..10), Wrap=True)
list_item_107 = ListItem(List=explode_27.Vertices, Index=Slider(1, range=0..10), Wrap=True)
list_item_108 = ListItem(List=explode_27.Vertices, Index=Slider(2, range=0..10), Wrap=True)
removeduplicatepts_26 = RemoveDuplicatePts(Points=explode_26.Vertices, Tolerance=0.01)
removeduplicatepts_27 = RemoveDuplicatePts(Points=explode_27.Vertices, Tolerance=0.01)
point_87 = Point(removeduplicatepts_26)
point_88 = Point(removeduplicatepts_27)
number_slider_112 = Slider(1.33, range=1..1.5)
number_slider_113 = Slider(0.022, range=0.022..0.099)
number_slider_114 = Slider(1.297, range=-10..10)
list_item_109 = ListItem(List=jitter_3.Values, Index=Slider(69, range=0..100), Wrap=True)
number_of_trunk_per_row_28 = Slider(9, range=0..10)
division_28 = Division(A=list_item_109, B=number_of_trunk_per_row_28)
addition_37 = Addition(A=number_slider_113, B=division_28)
construct_point_29 = ConstructPoint(XCoordinate=number_slider_112, YCoordinate=addition_37, ZCoordinate=Slider(0, range=0..100))
radians_28 = Radians(Degrees=number_slider_114)
surface_28 = Surface(reparameterize(geometry_13))
geometry_112 = Geometry(<brep referenced from the Rhino model>)
geometry_113 = Geometry(<curve referenced from the Rhino model>)
geometry_114 = Geometry(<mesh referenced from the Rhino model>)
# T7
evaluate_surface_28 = EvaluateSurface(Surface=surface_28, Point=construct_point_29)  # -> Point, Normal, UDirection, VDirection, Frame
unit_vector_29 = UnitVector(Vector=evaluate_surface_28.Normal)
geometry_115 = Geometry(<curve referenced from the Rhino model>)
point_89 = Point(<point referenced from the Rhino model>)
point_90 = Point(evaluate_surface_28.Point)
orient_direction_55 = OrientDirection(Geometry=geometry_115, PointA=point_89, DirectionA=unit_vector, PointB=point_90, DirectionB=unit_vector_29)  # -> Geometry, Transform
transform_163 = Transform(Geometry=geometry_112, Transform=orient_direction_55.Transform)
transform_164 = Transform(Geometry=geometry_113, Transform=orient_direction_55.Transform)
orient_direction_56 = OrientDirection(
    Geometry=orient_direction_55.Geometry,
    PointA=point_90,
    DirectionA=orient_direction_55.Geometry,
    PointB=point_90,
    DirectionB=evaluate_surface_28.UDirection)  # -> Geometry, Transform
rotate_28 = Rotate(Geometry=orient_direction_56.Geometry, Angle=radians_28, Plane=evaluate_surface_28.Frame)  # -> Geometry, Transform
transform_165 = Transform(Geometry=transform_163, Transform=orient_direction_56.Transform)
transform_166 = Transform(Geometry=transform_164, Transform=orient_direction_56.Transform)
transform_167 = Transform(Geometry=transform_165, Transform=rotate_28.Transform)
geometry_116 = Geometry([transform_143, transform_161, transform_125, transform_107, transform_89, transform_71, transform_53, transform_35, transform_17, transform_167])
transform_168 = Transform(Geometry=transform_166, Transform=rotate_28.Transform)
triangle_mapping_28 = TriangleMapping(Geometry=geometry_114, Source=geometry_113, Target=transform_168)  # -> Geometry, Transform
mesh_3 = Mesh([triangle_mapping_21.Geometry, triangle_mapping_24.Geometry, triangle_mapping_27.Geometry, triangle_mapping_18.Geometry, triangle_mapping_15.Geometry, triangle_mapping_12.Geometry, triangle_mapping_9.Geometry, triangle_mapping_6.Geometry, triangle_mapping_3.Geometry, triangle_mapping_28.Geometry])
# Optimization:
# AVOID COLLISION OF THE TRIANGLES
# While
# The triangles as close as possible
collision_many_many = CollisionManyMany(Colliders=flatten([geometry_111, geometry_110, geometry_116]))  # -> Collision, Indices
explode_28 = Explode(Curve=transform_168, Recursive=True)  # -> Segments, Vertices
list_item_110 = ListItem(List=explode_28.Vertices, Index=Slider(3, range=0..10), Wrap=True)
point_91 = Point([list_item_10, list_item_22, list_item_34, list_item_46, list_item_58, list_item_70, list_item_82, list_item_93, list_item_106, list_item_110])
list_item_111 = ListItem(List=explode_28.Vertices, Index=Slider(1, range=0..10), Wrap=True)
point_92 = Point([list_item_11, list_item_23, list_item_35, list_item_47, list_item_59, list_item_71, list_item_83, list_item_94, list_item_107, list_item_111])
closest_points_4 = ClosestPoints(Point=point_80, Cloud=point_92, Count=Slider(1, range=0..1))  # -> ClosestPoint, CPIndex, flatten(Distance)
number_4 = Number(closest_points_4.Distance)
list_item_112 = ListItem(List=explode_28.Vertices, Index=Slider(2, range=0..10), Wrap=True)
point_93 = Point([list_item_12, list_item_24, list_item_36, list_item_48, list_item_60, list_item_72, list_item_84, list_item_96, list_item_108, list_item_112])
closest_points_5 = ClosestPoints(Point=point_92, Cloud=point_93, Count=Slider(1, range=0..1))  # -> ClosestPoint, CPIndex, flatten(Distance)
number_5 = Number(closest_points_5.Distance)
removeduplicatepts_28 = RemoveDuplicatePts(Points=explode_28.Vertices, Tolerance=0.01)
mass_addition = MassAddition(Input=flatten([number_3, number_2, number, number_5, number_4]))  # -> Result, PartialResults
point_94 = Point(removeduplicatepts_28)
panel_7 = Panel(collision_many_many.Collision)
cull_pattern = CullPattern(List=collision_many_many.Collision, CullPattern=panel_7)
number_6 = Number(mass_addition.Result)
list_length = ListLength(List=cull_pattern)
addition_38 = Addition(A=list_length, B=Slider(1, range=0..1))
multiplication = Multiplication(A=addition_38, B=Slider(10, range=0..100000))
multiplication_2 = Multiplication(A=number_6, B=multiplication)
number_7 = Number(multiplication_2)
# Diagrid
# Support
galapagos = Galapagos(
    fitness=number_7,
    gene=[number_slider_5, number_slider_18, number_slider_17, number_slider_19, number_slider_23, number_slider_24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])
